# Dynamo custom node Get ColorFill Scheme Properties.dyf (Dynamo 2.6.2.15705)
# category: GeniusLoci.ColorScheme
# Works only in Revit 2022 and later.
# Gets the category, values, colors and fill patterns of the given Color Scheme.

colorFillScheme = Input(colorFillScheme: var)  # ColorFillScheme element or ColorFillScheme Name
python_script = Python(IN[0]=colorFillScheme)
# ---------- python_script.python (69 lines) ----------
#Alban de Chasteigner 2021
#twitter : @geniusloci_bim
#geniusloci.bim@gmail.com
#https://github.com/albandechasteigner/GeniusLociForDynamo
 
import clr
clr.AddReference('RevitAPI')
import Autodesk
from Autodesk.Revit.DB import *
clr.AddReference('RevitServices')
import RevitServices
from RevitServices.Persistence import DocumentManager
doc = DocumentManager.Instance.CurrentDBDocument

clr.AddReference('RevitNodes')
import Revit
clr.AddReference('DSCoreNodes')
import DSCore
from DSCore import Color

element = UnwrapElement(IN[0])

values,colors,visible,used,patterns=[],[],[],[],[]
if isinstance(element, Autodesk.Revit.DB.ColorFillScheme):
	scheme = element
elif isinstance(element, basestring):
	scheme = FilteredElementCollector(doc).OfCategory(BuiltInCategory.OST_ColorFillSchema).ToElements().Find(lambda x : x.Name == element)
entries = scheme.GetEntries()
name = scheme.Name
title = scheme.Title
linked = scheme.IsLinkedFilesIncluded
range = scheme.IsByRange
catId = scheme.CategoryId
category = Revit.Elements.Category.ById(catId.IntegerValue)
fec = FilteredElementCollector(doc).OfCategoryId(catId).ToElements()
try:
	#BuiltinParameter by Id
	BIP = (BuiltInParameter)(scheme.ParameterDefinition.IntegerValue)
	paramName = LabelUtils.GetLabelFor(BIP)
except:
	try:
		#Shared Parameter by Guid
		paramElem = doc.GetElement(scheme.ParameterDefinition)
		BIP = paramElem.GuidValue
		paramName = paramElem.Name
	except:
		#Project Parameter by Definition
		paramElem = doc.GetElement(scheme.ParameterDefinition)
		BIP = paramElem.GetDefinition()
		paramName = paramElem.Name
			
parameter = fec[0].get_Parameter(BIP)

for entry in entries:
	if entry.StorageType == StorageType.ElementId:
		value = entry.GetElementIdValue()
	elif entry.StorageType == StorageType.Double:
		value = round(UnitUtils.ConvertFromInternalUnits(entry.GetDoubleValue(),parameter.GetUnitTypeId()),3)
	elif entry.StorageType == StorageType.String:
		value = entry.GetStringValue()
	elif entry.StorageType == StorageType.Integer:
		value = UnitUtils.ConvertFromInternalUnits(entry.GetIntegerValue(),parameter.GetUnitTypeId())
	values.append(value)
	colors.append(DSCore.Color.ByARGB(255, entry.Color.Red, entry.Color.Green, entry.Color.Blue))
	patterns.append(doc.GetElement(entry.FillPatternId))
	visible.append(entry.IsVisible)
	used.append(entry.IsInUse)
	
OUT = name, category,paramName,title,linked, range, values, colors, patterns, visible, used, entries
# ----------------------------------------
code_block = CodeBlock(x=python_script) { x[0]; x[1]; x[2]; x[3]; x[4]; x[5]; x[6]; x[7]; x[8]; x[9]; x[10]; x[11]; }
Name = Output(code_block.out0)  # Color Scheme Name
Category = Output(code_block.out1)
ParameterName = Output(code_block.out2)
Title = Output(code_block.out3)
ElementsFromLinks = Output(code_block.out4)
ByRange = Output(code_block.out5)
Values = Output(code_block.out6)
Colors = Output(code_block.out7)
FillPatternElement = Output(code_block.out8)
IsVisible = Output(code_block.out9)
IsInUse = Output(code_block.out10)
Entries = Output(code_block.out11)
