# Dynamo custom node 3DView Collector.dyf (Dynamo 1.3.4.6666)
# category: GeniusLoci.View
# Retrieves the 3D views in the active or given document.

docOrRevitLinkInstance = Input(docOrRevitLinkInstance : var = null)  # Use only if you want to query a linked model
python_script = Python(IN[0]=docOrRevitLinkInstance)
# ---------- python_script.python (38 lines) ----------
import clr
# Import DocumentManager and TransactionManager
clr.AddReference("RevitServices")
import RevitServices
from RevitServices.Persistence import DocumentManager
# Import RevitAPI
clr.AddReference("RevitAPI")
import Autodesk
from Autodesk.Revit.DB import *
# Import ToDSType(bool) extension method
clr.AddReference("RevitNodes")
import Revit
clr.ImportExtensions(Revit.Elements)

#Part of script from Clockwork
inputdoc = UnwrapElement(IN[0])
if inputdoc == None:
	doc = DocumentManager.Instance.CurrentDBDocument
elif isinstance (inputdoc, RevitLinkInstance) :
	doc = inputdoc.GetLinkDocument()
elif isinstance (inputdoc, Document) :
	doc = inputdoc
else: doc = None

#collect all views in the model
views = FilteredElementCollector(doc).OfClass(View).ToElements()

#sort views into separate lists based on view type
threeD = []
for i in views:
	if not i.IsTemplate:
		if i.ViewType == ViewType.ThreeD:
			threeD.append(i.ToDSType(True))
		else:
			continue

#Assign your output to the OUT variable
OUT = threeD
# ----------------------------------------
n3D_views = Output(python_script)  # "3D views"
