# Dynamo custom node 3DView by BoundingBox.dyf (Dynamo 1.3.4.6666)
# category: GeniusLoci.View
# Use a boundingbox to create a new 3D View with a specified name and a section box.
# Inspired by an archilab node.

boundingBox = Input()
Viewname = Input()
python_script = Python(IN[0]=boundingBox, IN[1]=Viewname)
# ---------- python_script.python (50 lines) ----------
#Based on the codes originally posted by Dimitar Venkov and Konrad Sobon

import clr
clr.AddReference("RevitAPI")
import Autodesk
from Autodesk.Revit.DB import *

clr.AddReference("RevitNodes")
import Revit
clr.ImportExtensions(Revit.GeometryConversion)
clr.ImportExtensions(Revit.Elements)

clr.AddReference("RevitServices")
import RevitServices
from RevitServices.Persistence import DocumentManager
from RevitServices.Transactions import TransactionManager

doc = DocumentManager.Instance.CurrentDBDocument

def tolist(obj1):
    if hasattr(obj1,"__iter__"): return obj1
    else: return [obj1]

bboxs = tolist(IN[0])
viewNames = tolist(IN[1])
views=[]
#get ViewFamilyType for a 3D View
collector = FilteredElementCollector(doc)
viewTypeColl = collector.OfClass(ViewFamilyType)
for i in viewTypeColl:
	if i.ViewFamily == ViewFamily.ThreeDimensional:
		viewType = i
	else:
		continue

for bbox,viewName in zip(bboxs,viewNames):
	newmax = UnwrapElement(bbox.MaxPoint).ToRevitType()
	newmin = UnwrapElement(bbox.MinPoint).ToRevitType()
	newbox = BoundingBoxXYZ()
	newbox.Max = newmax
	newbox.Min = newmin
	
	TransactionManager.Instance.EnsureInTransaction(doc)
	view = View3D.CreateIsometric(doc, viewType.Id)
	view.Name = viewName
	view.SetSectionBox(newbox)
	views.append(view)
	TransactionManager.Instance.TransactionTaskDone()

OUT = views
# ----------------------------------------
Views = Output(python_script)
