# Dynamo custom node All Elements at Phase.dyf (Dynamo 1.3.4.6666)
# category: GeniusLoci.Phase
# Collect all elements at a given phase.

Phase = Input()
python_script = Python(IN[0]=Phase)
# ---------- python_script.python (19 lines) ----------
#Alban de Chasteigner 2020
#twitter : @geniusloci_bim
#geniusloci.bim@gmail.com

import clr
clr.AddReference('RevitAPI')
import Autodesk
from Autodesk.Revit.DB import *

phases = UnwrapElement(IN[0]) if isinstance(IN[0],list) else [UnwrapElement(IN[0])]
phaseList = []

for phase in phases :
	doc=phase.Document
	filter=ElementParameterFilter(ParameterFilterRuleFactory.CreateEqualsRule(ElementId(BuiltInParameter.PHASE_CREATED), phase.Id))
	phaseList.append(FilteredElementCollector(doc).WherePasses(filter).WhereElementIsNotElementType().ToElements())
	
if isinstance(IN[0], list): OUT = phaseList
else: OUT = phaseList[0]
# ----------------------------------------
Element = Output(python_script)
