# Dynamo custom node All Elements of System.dyf (Dynamo 1.3.4.6666)
# category: GeniusLoci.MEP
# Returns every element of the duct or piping network, including ducts, pipes, fittings, fixtures, equipments etc.

system = Input()  # MechanicalSystem, PipingSystem or element
python_script = Python(IN[0]=system)
# ---------- python_script.python (46 lines) ----------
import clr
#import Revit API
clr.AddReference('RevitAPI')
import Autodesk
from Autodesk.Revit.DB import *

clr.AddReference("RevitNodes")
import Revit
clr.ImportExtensions(Revit.Elements)

def getSystem(elem):
	mepsys = None
	if not isinstance(elem,MEPSystem):
		try:connSet = elem.MEPModel.ConnectorManager.Connectors
		except:connSet = elem.ConnectorManager.Connectors
		for con in connSet:
			if con.IsConnected:
				mepsys = con.MEPSystem
	else:mepsys = elem
	return 	mepsys
			
def getNetwork(system):
	network = None
	if isinstance(system, Mechanical.MechanicalSystem):
		try:
			network = [e.ToDSType(True) for e in system.DuctNetwork]
		except:
			pass
	elif isinstance(system, Plumbing.PipingSystem):
		try:
			network = [e.ToDSType(True) for e in system.PipingNetwork]
		except:
			pass
	return network

elems = UnwrapElement(IN[0]) if isinstance(IN[0],list) else [UnwrapElement(IN[0])]
systems,networkElements = [],[]

for e in elems:
	system = getSystem(e)
	networkElem = getNetwork(system)
	systems.append(system)
	networkElements.append(networkElem)
	
if isinstance(IN[0], list): OUT = networkElements,systems
else: OUT = networkElements[0],systems[0]
# ----------------------------------------
code_block = CodeBlock(x=python_script) { x[0]; x[1]; }
Elements = Output(code_block.out0)
System = Output(code_block.out1)
