# Dynamo custom node Annotation BoundingBox.dyf (Dynamo 1.3.4.6666)
# category: GeniusLoci.Geometry
# Get the BoundingBox of the view specific element. (Text, tag, etc)

element = Input()
python_script = Python(IN[0]=element)
# ---------- python_script.python (20 lines) ----------
import clr
clr.AddReference('RevitAPI')
import Autodesk
from Autodesk.Revit.DB import XYZ
clr.AddReference('RevitNodes')
import Revit
clr.ImportExtensions(Revit.GeometryConversion)

annotations=UnwrapElement(IN[0]) if isinstance(IN[0],list) else [UnwrapElement(IN[0])]
bbox,center = [],[]

for anno in annotations:
    viewId = anno.OwnerViewId
    view = anno.Document.GetElement(viewId)
    box=anno.BoundingBox[view]
    bbox.append(box.ToProtoType())
    center.append(((box.Min+box.Max)/2).ToPoint())

if isinstance(IN[0], list): OUT = bbox,center
else: OUT = bbox[0],center[0]
# ----------------------------------------
code_block = CodeBlock(x=python_script) { x[0]; x[1]; }
BoundingBox = Output(code_block.out0)
Centroid = Output(code_block.out1)  # Point
