# Dynamo custom node AppearanceAsset Create.dyf (Dynamo 1.3.4.6666)
# category: GeniusLoci.Material
# Works only in Revit 2018.1 and later.
# Create an AppearanceAsset by duplicating an existing rendering asset.
# Please note : The asset will be duplicated with all its properties (category, color, image...)
# For use with the AppearanceAsset Schema node.

Name = Input()
schema = Input(schema:string="GenericSchema")  # Titled "Type" in the Asset Browser
python_script = Python(IN[0]=Name, IN[1]=schema)
# ---------- python_script.python (37 lines) ----------
#Alban de Chasteigner 2019
#twitter : @geniusloci_bim
#geniusloci.bim@gmail.com

import clr
clr.AddReference('RevitAPI')
from Autodesk.Revit.DB import *
from Autodesk.Revit.DB.Visual import *
clr.AddReference('RevitServices')
import RevitServices
from RevitServices.Persistence import DocumentManager
from RevitServices.Transactions import TransactionManager
doc = DocumentManager.Instance.CurrentDBDocument
# Import ToDSType  (bool) extension method
clr.AddReference("RevitNodes")
import Revit
clr.ImportExtensions(Revit.Elements)
from Revit.Elements import *

def tolist(obj):
    if hasattr(obj, '__iter__'): return obj
    else: return [obj]
    
names = tolist(IN[0])
schema = tolist(IN[1])[0]
assets=[]

systemAppearanceAssets = doc.Application.GetAssets(AssetType.Appearance)
for asset in systemAppearanceAssets :
	for newName in names :
		if (asset.FindByName("BaseSchema")).Value == schema:
			TransactionManager.Instance.EnsureInTransaction(doc)
			create=AppearanceAssetElement.Create(doc,newName,asset)
			assets.append(create.ToDSType(False))
			TransactionManager.Instance.TransactionTaskDone()
	
OUT = assets
# ----------------------------------------
code_block = CodeBlock(passthrough=Name, waitfor=python_script) { {passthrough,waitfor}[0]; }
python_script_2 = Python(IN[0]=code_block)
# ---------- python_script_2.python (28 lines) ----------
#Alban de Chasteigner 2019
#twitter : @geniusloci_bim
#geniusloci.bim@gmail.com

import clr
clr.AddReference('RevitServices')
from RevitServices.Persistence import DocumentManager
doc = DocumentManager.Instance.CurrentDBDocument

clr.AddReference('RevitAPI')
from Autodesk.Revit.DB import *

def tolist(obj):
    if hasattr(obj, '__iter__'): return obj
    else: return [obj]
    
names = tolist(IN[0])
appareance=[]

appearanceAssets = FilteredElementCollector(doc).OfClass(AppearanceAssetElement).ToElements()

for appearanceAsset in appearanceAssets :
	for name in names:
		if appearanceAsset.Name == name:
			appareance.append(appearanceAsset)

if isinstance(IN[0], list): OUT = appareance
else: OUT = appareance[0]
# ----------------------------------------
AppearanceAsset = Output(python_script_2)
