# Dynamo custom node AppearanceAsset Schema.dyf (Dynamo 1.3.4.6666)
# category: GeniusLoci.Material
# Lists the 14 standard material schemas and the 5 "advanced" material schemas.
# For use with the AppearanceAsset Create node.

code_block = CodeBlock()
# ---------- code_block.designscript (1 lines) ----------
{"CeramicSchema","ConcreteSchema","GenericSchema","GlazingSchema","HardwoodSchema","MasonryCMUSchema","MetalSchema","MetallicPaintSchema","MirrorSchema","PrismLayeredSchema","PrismMetalSchema","PrismOpaqueSchema","PrismTransparentSchema","PrismWoodSchema","PlasticVinylSchema","SolidGlassSchema","StoneSchema","WallPaintSchema","WaterSchema"};
# ----------------------------------------
Schemas = Output(code_block)
