# Dynamo custom node AppearanceAsset Set Properties.dyf (Dynamo 2.12.0.5650)
# category: GeniusLoci.Material
# Set the properties and their values in the given AppearanceAssetElement.
# You can find the property's name with the AppearanceAsset Get Properties node.

appearanceAsset = Input(appearanceAsset: var[]..[])
property = Input(property: string[]..[])
value = Input(value: var[]..[])
set_properties = Python(IN[0]=appearanceAsset, IN[1]=property, IN[2]=value)  # IronPython2
# ---------- set_properties.python (47 lines) ----------
#Alban de Chasteigner 2022
#twitter : @geniusloci_bim
#geniusloci.bim@gmail.com
#https://github.com/albandechasteigner/GeniusLociForDynamo

import clr
clr.AddReference('RevitAPI')
from Autodesk.Revit.DB import *
from Autodesk.Revit.DB.Visual import *
clr.AddReference('RevitServices')
import RevitServices
from RevitServices.Persistence import DocumentManager
from RevitServices.Transactions import TransactionManager
doc = DocumentManager.Instance.CurrentDBDocument

def toList(obj):
    if hasattr(obj, '__iter__'): return obj
    else: return [obj]
    
assetElems = toList(UnwrapElement(IN[0]))
parameters = toList(IN[1])
values = toList(IN[2])

val_len = len(values) == 1

def ToRevitColor(dynamoColor):
	return Color(dynamoColor.Red, dynamoColor.Green, dynamoColor.Blue)

for assetElem in assetElems :
	for i in xrange(len(parameters)):
		param = parameters[i]
		v = 0 if val_len else i
		TransactionManager.Instance.EnsureInTransaction(doc)
		with Visual.AppearanceAssetEditScope(assetElem.Document) as editScope:
			editableAsset = editScope.Start(assetElem.Id)
			property = editableAsset.FindByName(param)
			if param == "UIName":
				assetElem.Name = values[v]
			if property.IsEditable():
				if not isinstance(property, AssetPropertyDoubleArray4d):
					property.Value = values[v]
				else: 
					property.SetValueAsColor(ToRevitColor(values[v]))
			editScope.Commit(True)
		TransactionManager.Instance.TransactionTaskDone()

OUT = IN[0]
# ----------------------------------------
AppearanceAssetElement = Output(set_properties)
