# Dynamo custom node Compound Edges References.dyf (Dynamo 1.3.4.6666)
# category: GeniusLoci.Reference
# Get the vertical edges and their references of the roof, floor, ceiling or wall.
# Also works with linked element.

element = Input()  # Roof, floor, ceiling or wall
python_script = Python(IN[0]=element)
# ---------- python_script.python (48 lines) ----------
#Alban de Chasteigner 2019
#twitter : @geniusloci_bim
#geniusloci.bim@gmail.com

import clr
clr.AddReference('RevitAPI')
import Autodesk
from Autodesk.Revit.DB import *

clr.AddReference('RevitNodes')
import Revit
clr.ImportExtensions(Revit.GeometryConversion)
clr.ImportExtensions(Revit.Elements)
from Revit.Elements import *

items = UnwrapElement(IN[0]) if isinstance(IN[0],list) else [UnwrapElement(IN[0])]

def split_half(a):
	half = len(a) >> 1
	#return a[:half], a[half:]
	return a[half:]

allHorizEdges,allVertEdges,allVertReferences=[],[],[]

opt = Options()
opt.ComputeReferences = True
#opt.IncludeNonVisibleObjects = True
#opt.View = doc.ActiveView
for item in items:
	for obj in item.get_Geometry(opt):
		if isinstance(obj, Solid):
			gline = obj
			vertEdges,horizEdges,vertReferences=[],[],[]
			for edges in gline.Edges:
				if round(edges.AsCurve().GetEndPoint(0).ToPoint().Z,10) != round(edges.AsCurve().GetEndPoint(1).ToPoint().Z,10):
					vertEdges.append(edges.AsCurve().ToProtoType())
					vertReferences.append(edges.Reference)
				else:
					horizEdges.append(edges.AsCurve().ToProtoType())
			if isinstance(item, Autodesk.Revit.DB.Wall):
				allHorizEdges.append(horizEdges)
			else:
				allHorizEdges.append(split_half(horizEdges))
			allVertEdges.append(vertEdges)
			allVertReferences.append(vertReferences)
		
if isinstance(IN[0], list): OUT = allHorizEdges,allVertEdges,allVertReferences
else: OUT = allHorizEdges[0],allVertEdges[0],allVertReferences[0]
# ----------------------------------------
code_block = CodeBlock(x=python_script) { x[0]; x[1]; x[2]; }
Horizontal_Edges = Output(code_block.out0)
Vertical_Edges = Output(code_block.out1)
Vertical_References = Output(code_block.out2)
