# Dynamo custom node Convert from InternalOrigin CoordinateSystem.dyf (Dynamo 1.3.4.6666)
# category: GeniusLoci.Geometry
# Get the location point in the 3 coordinate systems : Shared Coordinates, Project Coordinates, Relative Origin Coordinates.
# Based on a Daniel Woodcock's script.

point = Input(point: Autodesk.DesignScript.Geometry.Point[])  # Point in Internal Origin System
python_script = Python(IN[0]=point)
# ---------- python_script.python (88 lines) ----------
#Based on a script by Daniel Woodcock

import clr
import math
clr.AddReference('ProtoGeometry')
from Autodesk.DesignScript import Geometry as geom
clr.AddReference("RevitServices")
import RevitServices 
from RevitServices.Persistence import DocumentManager
doc = DocumentManager.Instance.CurrentDBDocument
uiapp = DocumentManager.Instance.CurrentUIApplication
app = uiapp.Application
clr.AddReference("RevitNodes")
import Revit
clr.ImportExtensions(Revit.Elements)
clr.ImportExtensions(Revit.GeometryConversion)
clr.AddReference('RevitAPI')
from Autodesk.Revit.DB import*
import Autodesk

version=int(app.VersionNumber)
	
UIunit = Document.GetUnits(doc).GetFormatOptions(UnitType.UT_Length).DisplayUnits

# Create a list object from singleton...
def tolist(obj1):
	if hasattr(obj1,"__iter__"): return obj1
	else: return [obj1]
	
# Convert Point from Relative to Shared Coordinates...
def ToSharedCoordinates(pt,iop,pbp,rot):
	# First we need to translate the point by adding the Internal Origin to the Point we're converting...
	pt = geom.Point.ByCoordinates(pt.X+iop.X, pt.Y+iop.Y, pt.Z+iop.Z)
	# Then we need to rotate this point about the Internal Origin in the opposite direction as the Project Rotation...
	pt = geom.Geometry.Rotate(pt,iop,geom.Vector.ZAxis(),rot*-1)
	return pt

# Convert Point from Relative to Project Coordinates...
def ToProjectCoordinates(pt,iop,pbp,rot):
	# First we need to Rotate the Project Base Point about the Internal Origin Point by the Project Rotation...
	pbp = geom.Geometry.Rotate(pbp,iop,geom.Vector.ZAxis(),rot)
	# Then we need to Translate the point we're converting by subtracting the Project Base Point and then adding the Internal Origin Point...
	pt = geom.Point.ByCoordinates(pt.X-pbp.X+iop.X,pt.Y-pbp.Y+iop.Y,pt.Z-pbp.Z+iop.Z)
	return pt

# Input Variables...
pts = tolist(IN[0])
 
# Internal Variables...
pbp = None
iop = None
rot = 0
 
# Output Variables...
shared = []
project = []
relative = []

# Collect Project Basepoint...
basePt = FilteredElementCollector(doc).OfCategory(BuiltInCategory.OST_ProjectBasePoint).ToElements()
 
# Convert Project Basepoint (pbp) to DS Point...
for e in basePt:
	# Get Project Base Points Parameter Values...
	ew = Autodesk.Revit.DB.UnitUtils.ConvertFromInternalUnits(e.get_Parameter(BuiltInParameter.BASEPOINT_EASTWEST_PARAM).AsDouble(),UIunit)
	ns = Autodesk.Revit.DB.UnitUtils.ConvertFromInternalUnits(e.get_Parameter(BuiltInParameter.BASEPOINT_NORTHSOUTH_PARAM).AsDouble(),UIunit)
	ele = Autodesk.Revit.DB.UnitUtils.ConvertFromInternalUnits(e.get_Parameter(BuiltInParameter.BASEPOINT_ELEVATION_PARAM).AsDouble(),UIunit)
	rot = e.get_Parameter(BuiltInParameter.BASEPOINT_ANGLETON_PARAM).AsDouble()*180/math.pi    
	# Create Point from Project Base Point Values...
	pbp = geom.Point.ByCoordinates(ew,ns,ele)

# Convert Internal Origin Point (iop) as DS Point...
if version > 2017:
	projPos = doc.ActiveProjectLocation.GetProjectPosition(XYZ(0,0,0))
else :
	projPos = doc.ActiveProjectLocation.get_ProjectPosition(XYZ(0,0,0))

iop = geom.Point.ByCoordinates((Autodesk.Revit.DB.UnitUtils.ConvertFromInternalUnits(projPos.EastWest,UIunit)),(Autodesk.Revit.DB.UnitUtils.ConvertFromInternalUnits(projPos.NorthSouth,UIunit)),0)
 
for pt in pts:
# Convert point to Shared Coordinates...
	shared.append(ToSharedCoordinates(pt,iop,pbp,rot))
	# Convert point to Project Coordinates...
	project.append(ToProjectCoordinates(pt,iop,pbp,rot))
	# Point is already Relative to the Internal Origin...
	relative.append(pt)
     
OUT = shared, project, relative
# ----------------------------------------
code_block = CodeBlock(x=python_script) { x[0]; x[1]; x[2]; }
Point_Survey_System = Output(code_block.out0)  # "Point (Survey System)"
Point_Project_Base_Pt_System = Output(code_block.out1)  # "Point (Project Base Pt System)"
Point_Internal_Origin_System = Output(code_block.out2)  # "Point (Internal Origin System)"
