# Dynamo custom node Convert from ProjectBasePoint CoordinateSystem.dyf (Dynamo 1.3.4.6666)
# category: GeniusLoci.Geometry
# Convert from Project Base Point Coordinate to Internal Origin Coordinate.

point = Input(point: Autodesk.DesignScript.Geometry.Point[]..[])  # Point in Project BasePoint Coordinate System
code_block = CodeBlock(point=point) { geometry1 = Autodesk.DesignScript.Geometry.Transform(point, CoordinateSystem.Identity(), CoordinateSystem.ByOrigin(Coordinates.BasePoint())); }
Point = Output(code_block)  # Point in Internal Origin Coordinate System
