# Dynamo custom node Convert from SurveyPoint CoordinateSystem.dyf (Dynamo 1.3.4.6666)
# category: GeniusLoci.Geometry
# Convert from Survey Coordinate to Internal Origin Coordinate.

get_basepoint = Python()
# ---------- get_basepoint.python (44 lines) ----------
#Alban de Chasteigner 2020
#twitter : @geniusloci_bim
#geniusloci.bim@gmail.com
#https://github.com/albandechasteigner/GeniusLociForDynamo

import clr
clr.AddReference("RevitServices")
import RevitServices 
from RevitServices.Persistence import DocumentManager
uiapp = DocumentManager.Instance.CurrentUIApplication
app = uiapp.Application
version=int(app.VersionNumber)

clr.AddReference("RevitNodes")
import Revit
clr.ImportExtensions(Revit.GeometryConversion)

clr.AddReference("RevitAPI")
import Autodesk
from Autodesk.Revit.DB import Document, UnitType, FilteredElementCollector, BuiltInCategory, XYZ

doc = DocumentManager.Instance.CurrentDBDocument

angleUnit = Document.GetUnits(doc).GetFormatOptions(UnitType.UT_Angle).DisplayUnits

outProjBasePt = []

pbp = FilteredElementCollector(doc).OfCategory(BuiltInCategory.OST_ProjectBasePoint).ToElements()

if version < 2018:
	projPos = doc.ActiveProjectLocation.get_ProjectPosition(XYZ(0,0,0))
else :
	projPos = doc.ActiveProjectLocation.GetProjectPosition(XYZ(0,0,0))
	
if version > 2019 :
	outProjBasePt = [pbp[0].SharedPosition.ToPoint(),abs(round(Autodesk.Revit.DB.UnitUtils.ConvertFromInternalUnits(projPos.Angle,angleUnit),6))]
else :
	pbpEW = pbp[0].get_Parameter(BuiltInParameter.BASEPOINT_EASTWEST_PARAM).AsDouble()
	pbpNS = pbp[0].get_Parameter(BuiltInParameter.BASEPOINT_NORTHSOUTH_PARAM).AsDouble()
	pbpElev = pbp[0].get_Parameter(BuiltInParameter.BASEPOINT_ELEVATION_PARAM).AsDouble()
	pbpAngle = pbp[0].get_Parameter(BuiltInParameter.BASEPOINT_ANGLETON_PARAM).AsDouble()*180/math.pi    
	outProjBasePt=[(XYZ(pbpEW,pbpNS,pbpElev)).ToPoint(),round(pbpAngle,6)]
	
OUT = outProjBasePt
# ----------------------------------------
point = Input(point: Autodesk.DesignScript.Geometry.Point[]..[])  # Point in Survey Coordinate System
code_block = CodeBlock(bp=get_basepoint, point=point)
# ---------- code_block.designscript (3 lines) ----------
coordinate = CoordinateSystem.Rotate(CoordinateSystem.ByOrigin(bp[0]), bp[0], Autodesk.DesignScript.Vector.ZAxis(), 360 - bp[1]);
coordinate2 = CoordinateSystem.ByOrigin(Coordinates.BasePoint());
Autodesk.DesignScript.Geometry.Transform(point, coordinate, coordinate2);
# ----------------------------------------
Point = Output(code_block.out2)  # Point in Internal Origin Coordinate System
