# Dynamo custom node Create DWG Export Setup.dyf (Dynamo 1.3.4.6666)
# category: GeniusLoci.CAD Export
# Sets export option values and creates a DWG Export Settings.

DWGExportSetupName = Input(DWGExportSetupName : string)
ColorMode = Input(ColorMode : string = "IndexColors")  # String or Autodesk.Revit.DB.ExportColorMode Use the Enumerate DWG export options node
AutoCADVersion = Input(AutoCADVersion : string = "Default")  # String or Autodesk.Revit.DB.ACADVersion Use the Enumerate DWG export options node
units = Input(units : string = "Meter")  # String or Autodesk.Revit.DB.ExportUnit Use the Enumerate DWG export options node
SharedCoordinates = Input(SharedCoordinates:bool=true)
MergeViews = Input(MergeViews : bool = true)
python_script = Python(IN[0]=DWGExportSetupName, IN[1]=ColorMode, IN[2]=AutoCADVersion, IN[3]=units, IN[4]=SharedCoordinates, IN[5]=MergeViews)
# ---------- python_script.python (43 lines) ----------
#Alban de Chasteigner 2020
#twitter : @geniusloci_bim
#geniusloci.bim@gmail.com
#https://github.com/albandechasteigner/GeniusLociForDynamo

import clr
clr.AddReference("RevitServices")
import RevitServices
from RevitServices.Persistence import DocumentManager
from RevitServices.Transactions import TransactionManager
doc = DocumentManager.Instance.CurrentDBDocument
# Import RevitAPI
clr.AddReference("RevitAPI")
import Autodesk
from Autodesk.Revit.DB import *
import System

name = IN[0]
options = DWGExportOptions()
if isinstance(IN[1], Autodesk.Revit.DB.ExportColorMode):
	colors=IN[1]
else:
	colors=System.Enum.Parse(Autodesk.Revit.DB.ExportColorMode, IN[1])
options.Colors = colors
if isinstance(IN[2], Autodesk.Revit.DB.ACADVersion):
	version=IN[2]
else:
	version=System.Enum.Parse(Autodesk.Revit.DB.ACADVersion, IN[2])
options.FileVersion = version
if isinstance(IN[3], Autodesk.Revit.DB.ExportUnit):
	unit=IN[3]
else:
	unit=System.Enum.Parse(Autodesk.Revit.DB.ExportUnit, IN[3])
options.TargetUnit = unit
options.SharedCoords = IN[4]
options.MergedViews = IN[5]
options.LayerMapping = ""

TransactionManager.Instance.EnsureInTransaction(doc)
result = Autodesk.Revit.DB.ExportDWGSettings.Create(doc,name,options)
TransactionManager.Instance.TransactionTaskDone()

OUT = result
# ----------------------------------------
ExportDWGSettings = Output(python_script)
