# Dynamo custom node Create Legend Component.dyf (Dynamo 1.3.4.6666)
# category: GeniusLoci.Element
# Inserts a new legend component by duplicating an existing in the given legend view.
# Please note : At least one legend component must be placed in the legend view.

view = Input()  # Legend view
familyType = Input(familyType:var[]..[])
location = Input(location: Autodesk.DesignScript.Geometry.Point[]..[])  # Point where the component is to be placed
python_script = Python(IN[0]=view, IN[1]=familyType, IN[2]=location)
# ---------- python_script.python (46 lines) ----------
#Idea by Oliwer Kulpa : https://thebuildingcoder.typepad.com/blog/2010/05/duplicate-legend-component.html
import clr
# Import RevitAPI Classes
clr.AddReference('RevitAPI')
import Autodesk
from Autodesk.Revit.DB import *

clr.AddReference("RevitNodes")
import Revit
clr.ImportExtensions(Revit.GeometryConversion)

# Import DocumentManager and TransactionManager
clr.AddReference("RevitServices")
import RevitServices
from RevitServices.Persistence import DocumentManager
from RevitServices.Transactions import TransactionManager

doc = DocumentManager.Instance.CurrentDBDocument

view = UnwrapElement(IN[0]) if isinstance(IN[0],list) else [UnwrapElement(IN[0])]
view=view[0]
family_types = UnwrapElement(IN[1]) if isinstance(IN[1],list) else [UnwrapElement(IN[1])]
translations = IN[2] if isinstance(IN[2],list) else [IN[2]]
output=[]

existing_legend_component = FilteredElementCollector(doc, view.Id).OfCategory(BuiltInCategory.OST_LegendComponents).FirstElement()
# Get the location of the existing_legend_component
box = existing_legend_component.BoundingBox[view]
mid = (box.Min+box.Max)/2
x=mid.X*-1
y=mid.Y*-1
# Start Transaction
TransactionManager.Instance.EnsureInTransaction(doc)
for translation,family_type in zip(translations,family_types):
	# Copy the existing legend component with a translation relative to him
	new_legend_component = ElementTransformUtils.CopyElement(doc, existing_legend_component.Id,translation.ToRevitType())
	# Translate the new element to the chosen location
	ElementTransformUtils.MoveElement(doc,new_legend_component[0],XYZ(x,y,0))
	# Change the family type of the new element
	doc.GetElement(new_legend_component[0]).get_Parameter(BuiltInParameter.LEGEND_COMPONENT).Set(family_type.Id)
	output.append(doc.GetElement(new_legend_component[0]))
doc.Regenerate()
# End Transaction
TransactionManager.Instance.TransactionTaskDone()

OUT=output
# ----------------------------------------
Legend_Component = Output(python_script)
