# Dynamo custom node Create OverrideGraphicSettings.dyf (Dynamo 1.3.4.6666)
# category: GeniusLoci.Graphics
# Create a OverrideGraphicSettings (All graphic inputs are optional).
# Unlike the OOTB OverrideGraphicSettings.ByProperties node, the Foreground and background patterns are available.
# Note : Prior to Revit 2019, the materials have only one surface pattern and one cut pattern.

ProjectionLinePattern = Input(ProjectionLinePattern:var[]..[]=null)
ProjectionLineColor = Input(ProjectionLineColor:var[]..[]=null)  # Dynamo Color
ProjectionLineWeight = Input(ProjectionLineWeight:var[]..[]=null)  # Integer within the range 1-16
SurfaceForegroundPattern = Input(SurfaceForegroundPattern:var[]..[]=null)
SurfaceForegroundPatternColor = Input(SurfaceForegroundPatternColor:var[]..[] = null)  # Dynamo Color
SurfaceBackgroundPattern = Input(SurfaceBackgroundPattern:var[]..[]=null)
SurfaceBackgroundColor = Input(SurfaceBackgroundColor:var[]..[] = null)  # Dynamo Color
CutLinePattern = Input(CutLinePattern:var[]..[]=null)
CutLineColor = Input(CutLineColor:var[]..[]=null)  # Dynamo Color
CutLineWeight = Input(CutLineWeight:var[]..[]=null)  # Integer within the range 1-16
CutForegroundPattern = Input(CutForegroundPattern:var[]..[]=null)
CutForegroundPatternColor = Input(CutForegroundPatternColor:var[]..[] = null)  # Dynamo Color
CutBackgroundPattern = Input(CutBackgroundPattern:var[]..[]=null)
CutBackgroundPatternColor = Input(CutBackgroundPatternColor:var[]..[] = null)  # Dynamo Color
Transparency = Input(Transparency:var[]..[]=null)  # Integer
Halftone = Input(Halftone:var[]..[] = null)  # Boolean. True = halftone
python_script = Python(IN[0]=ProjectionLinePattern, IN[1]=ProjectionLineColor, IN[2]=ProjectionLineWeight, IN[3]=SurfaceForegroundPattern, IN[4]=SurfaceForegroundPatternColor, IN[5]=SurfaceBackgroundPattern, IN[6]=SurfaceBackgroundColor, IN[7]=CutLinePattern, IN[8]=CutLineColor, IN[9]=CutLineWeight, IN[10]=CutForegroundPattern, IN[11]=CutForegroundPatternColor, IN[12]=CutBackgroundPattern, IN[13]=CutBackgroundPatternColor, IN[14]=Transparency, IN[15]=Halftone)
# ---------- python_script.python (151 lines) ----------
import clr
#Import the Revit API
clr.AddReference('RevitAPI')
import Autodesk
from Autodesk.Revit.DB import *

#Import DocumentManager and TransactionManager
clr.AddReference('RevitServices')
import RevitServices
from RevitServices.Persistence import DocumentManager

doc = DocumentManager.Instance.CurrentDBDocument
uiapp = DocumentManager.Instance.CurrentUIApplication
app = uiapp.Application
version=int(app.VersionNumber)

def tolist(obj1):
	if hasattr(obj1,"__iter__"): return obj1
	else: return [obj1]
	
def ConvertColor(e):
	return Autodesk.Revit.DB.Color(e.Red, e.Green, e.Blue)

projLinePats = tolist(UnwrapElement(IN[0]))
projLineColors = tolist(IN[1])
projLineWeights = tolist(IN[2])
surfaceForePats = tolist(UnwrapElement(IN[3]))
surfaceForePatcolors = tolist(IN[4])
surfaceBackPats = tolist(UnwrapElement(IN[5]))
surfaceBackPatcolors = tolist(IN[6])
cutLinePats = tolist(UnwrapElement(IN[7]))
cutLineColors = tolist(IN[8])
cutLineWeights = tolist(IN[9])
cutForePats = tolist(UnwrapElement(IN[10]))
cutForePatcolors = tolist(IN[11])
cutBackPats = tolist(UnwrapElement(IN[12]))
cutBackPatcolors = tolist(IN[13])
transparencies = tolist(IN[14])
halftones = tolist(IN[15])

for projLinePat, projLineColor,projLineWeight,surfaceForePat,surfaceForePatcolor, surfaceBackPat, surfaceBackPatcolor, cutLinePat, cutLineColor,cutLineWeight,cutForePat, cutForePatcolor,cutBackPat, cutBackPatcolor,transparency,halftone in zip(projLinePats, projLineColors,projLineWeights, surfaceForePats,surfaceForePatcolors, surfaceBackPats, surfaceBackPatcolors, cutLinePats, cutLineColors,cutLineWeights,cutForePats, cutForePatcolors,cutBackPats, cutBackPatcolors,transparencies,halftones):
	#Create the OverridesGraphicsSettings
	ogs = OverrideGraphicSettings()
	if projLinePat == None:
		pass
	else:
		ogs.SetProjectionLinePatternId(projLinePat.Id)
	if projLineColor == None:
		pass
	else:
		ogs.SetProjectionLineColor(ConvertColor(projLineColor))
	if projLineWeight == None:
		pass
	else:
		ogs.SetProjectionLineWeight(projLineWeight)
	if cutLinePat == None:
		pass
	else:
		ogs.SetCutLinePatternId(cutLinePat.Id)
	if cutLineColor == None:
		pass
	else:
		ogs.SetCutLineColor(ConvertColor(cutLineColor))
	if cutLineWeight == None:
		pass
	else:
		ogs.SetCutLineWeight(cutLineWeight)
	if transparency == None:
		pass
	else:
		ogs.SetSurfaceTransparency(transparency)
	if halftone == None:
		pass
	else:
		ogs.SetHalftone(halftone)
	if version < 2019 :
		if surfaceForePatcolor == None:
			pass
		else:
			ogs.SetProjectionFillColor(ConvertColor(surfaceForePatcolor))
		if surfaceForePat == None:
			pass
		else:
			ogs.SetProjectionFillPatternId(surfaceForePat.Id)
			ogs.SetProjectionFillPatternVisible(True)
		if surfaceBackPatcolor == None:
			pass
		else:
			ogs.SetProjectionFillColor(ConvertColor(surfaceBackPatcolor))
		if surfaceBackPat == None:
			pass
		else:
			ogs.SetProjectionFillPatternId(surfaceBackPat.Id)
			ogs.SetProjectionFillPatternVisible(True)
		if cutForePatcolor == None:
			pass
		else:
			ogs.SetCutFillColor(ConvertColor(cutForePatcolor))
		if cutForePat == None:
			pass
		else:
			ogs.SetCutFillPatternId(cutForePat.Id)
			ogs.SetCutFillPatternVisible(True)
		if cutBackPatcolor == None:
			pass
		else:
			ogs.SetCutFillColor(ConvertColor(cutBackPatcolor))
		if cutBackPat == None:
			pass
		else:
			ogs.SetCutFillPatternId(cutBackPat.Id)
			ogs.SetCutFillPatternVisible(True)
	else:
		if surfaceForePatcolor == None:
			pass
		else:
			ogs.SetSurfaceForegroundPatternColor(ConvertColor(surfaceForePatcolor))
		if surfaceForePat == None:
			pass
		else:
			ogs.SetSurfaceForegroundPatternId(surfaceForePat.Id)
			ogs.SetSurfaceForegroundPatternVisible(True)
		if surfaceBackPatcolor == None:
			pass
		else:
			ogs.SetSurfaceBackgroundPatternColor(ConvertColor(surfaceBackPatcolor))
		if surfaceBackPat == None:
			pass
		else:
			ogs.SetSurfaceBackgroundPatternId(surfaceBackPat.Id)
			ogs.SetSurfaceBackgroundPatternVisible(True)	
		if cutForePatcolor == None:
			pass
		else:
			ogs.SetCutForegroundPatternColor(ConvertColor(cutForePatcolor))
		if cutForePat == None:
			pass
		else:
			ogs.SetCutForegroundPatternId(cutForePat.Id)
			ogs.SetCutForegroundPatternVisible(True)
		if cutBackPatcolor == None:
			pass
		else:
			ogs.SetCutBackgroundPatternColor(ConvertColor(cutBackPatcolor))
		if cutBackPat == None:
			pass
		else:
			ogs.SetCutBackgroundPatternId(cutBackPat.Id)
			ogs.SetCutBackgroundPatternVisible(True)

OUT = ogs
# ----------------------------------------
overrides = Output(python_script)
