# Dynamo custom node Create Sheet List Schedule.dyf (Dynamo 1.3.3.4651)
# category: GeniusLoci.Schedule
# Create a Sheet List Schedule with Sheet Number, Sheet Name, Current Revision and Current Revision Date.

sheet_list = Python()
# ---------- sheet_list.python (29 lines) ----------
#Alban de Chasteigner 2018
#twitter : @geniusloci_bim
#geniusloci.bim@gmail.com
import clr
clr.AddReference('RevitAPI')
import Autodesk
from Autodesk.Revit.DB import *

clr.AddReference("RevitNodes")
import Revit
clr.ImportExtensions(Revit.Elements)

clr.AddReference("RevitServices")
import RevitServices
from RevitServices.Persistence import DocumentManager
from RevitServices.Transactions import TransactionManager

doc = DocumentManager.Instance.CurrentDBDocument

TransactionManager.Instance.EnsureInTransaction(doc) 
sheetList = Autodesk.Revit.DB.ViewSchedule.CreateSheetList(doc) 
TransactionManager.Instance.TransactionTaskDone()

fields = sheetList.Definition.GetSchedulableFields()
fieldList=[]
for f in fields:
	name=f.GetName(doc) 
	fieldList.append(name)
OUT = sheetList,fieldList,fields
# ----------------------------------------
code_block = CodeBlock(x=sheet_list) { x[0]; x[2]; }
code_block_2 = CodeBlock(x=code_block.out1) { x[{23,24,18,16}]; }
addFields = Python(IN[0]=code_block.out0, IN[1]=code_block_2)  # "ScheduleView.AddFields"
# ---------- addFields.python (28 lines) ----------
#Alban de Chasteigner 2018
#twitter : @geniusloci_bim
#geniusloci.bim@gmail.com
import clr
clr.AddReference('RevitAPI')
import Autodesk
from Autodesk.Revit.DB import *

clr.AddReference("RevitNodes")
import Revit
clr.ImportExtensions(Revit.Elements)

clr.AddReference("RevitServices")
import RevitServices
from RevitServices.Persistence import DocumentManager
from RevitServices.Transactions import TransactionManager

doc = DocumentManager.Instance.CurrentDBDocument

viewSchedule = UnwrapElement(IN[0])
schedulableFields = UnwrapElement(IN[1])

TransactionManager.Instance.EnsureInTransaction(doc)
for schedulableField in schedulableFields:
	viewSchedule.Definition.AddField(schedulableField) 
TransactionManager.Instance.TransactionTaskDone()

OUT = viewSchedule
# ----------------------------------------
ViewSchedule = Output(addFields)
