# Dynamo custom node Delete Compound Layer.dyf (Dynamo 1.3.4.6666)
# category: GeniusLoci.CompoundStructure
# Removes a layer at the given index in the compound system family (wall, floor, roof or ceiling).

ElementOrFamilyType = Input()
index = Input(index: int[]..[])  # The index of the layer (The first index is 0) Counts from the exterior of the wall and from the top of roof, floor and ceiling.
python_script = Python(IN[0]=ElementOrFamilyType, IN[1]=index)
# ---------- python_script.python (82 lines) ----------
#Alban de Chasteigner 2020
#twitter : @geniusloci_bim
#geniusloci.bim@gmail.com

import clr
clr.AddReference('RevitAPI')
import Autodesk
from Autodesk.Revit.DB import *

clr.AddReference('RevitServices')
import RevitServices
from RevitServices.Persistence import DocumentManager
from RevitServices.Transactions import TransactionManager
doc = DocumentManager.Instance.CurrentDBDocument

import System
from System.Collections.Generic import List

def tolist(obj1):
    if hasattr(obj1,"__iter__"): return obj1
    else: return [obj1]

elements = tolist(UnwrapElement(IN[0]))
index = tolist(IN[1])

outList,boolList = [], []
layersToKeep = List[CompoundStructureLayer]()

for elem in elements :
	if isinstance(elem, ElementType):
		famType=elem
	elif isinstance(elem, Wall):
		famType = elem.WallType
	elif isinstance(elem, Floor):
		famType = elem.FloorType
	elif isinstance(elem, Roof) or isinstance(elem, FootPrintRoof) or isinstance(elem, ExtrusionRoof) or isinstance(elem, RoofBase) :
		famType = elem.RoofType
	elif isinstance(elem, Ceiling) or isinstance(elem, FaceWall) :
		famType = doc.GetElement(elem.GetTypeId())
	else:
		pass
	compStr = famType.GetCompoundStructure()
	layers=list(compStr.GetLayers())
	structural=compStr.StructuralMaterialIndex
	#index before the structural layer
	count = sum(i < structural for i in index) 
	idx = 0
	while idx < compStr.LayerCount:
		boolList.Add(compStr.ParticipatesInWrapping(idx))
		idx = idx+1
	firstCoreLayerIndex = compStr.GetFirstCoreLayerIndex()
	lastCoreLayerIndex = compStr.GetLastCoreLayerIndex()
	numberOfShellLayExt = compStr.GetNumberOfShellLayers(ShellLayerType.Exterior)
	numberOfShellLayInt = compStr.GetNumberOfShellLayers(ShellLayerType.Interior)
	
	TransactionManager.Instance.EnsureInTransaction(doc)
	for idx in sorted(index, reverse=True):
		del boolList[idx]
		if (idx < firstCoreLayerIndex) :
			numberOfShellLayExt -= 1
		if (idx > lastCoreLayerIndex):
			numberOfShellLayInt -= 1
	layersToKeep=[l for l in layers if l.LayerId not in index]
	try:
		compStr.SetLayers(layersToKeep)
		compStr.SetNumberOfShellLayers(ShellLayerType.Exterior, numberOfShellLayExt)
		compStr.SetNumberOfShellLayers(ShellLayerType.Interior, numberOfShellLayInt)
		if structural not in index :
			compStr.StructuralMaterialIndex=structural-count 
		idx = 0
		while idx < compStr.LayerCount:
			if idx < compStr.GetFirstCoreLayerIndex() or idx > compStr.GetLastCoreLayerIndex() :
				compStr.SetParticipatesInWrapping(idx, boolList[idx])
			idx = idx+1
		famType.SetCompoundStructure(compStr)
		outList.append(famType)
	except Exception, e:
		outList.append("Failed:-\n" + e.message)
	TransactionManager.Instance.TransactionTaskDone()

if isinstance(IN[0], list): OUT = outList
else: OUT = outList[0]
# ----------------------------------------
FamilyType = Output(python_script)
