# Dynamo custom node Delete Elements in Document.dyf (Dynamo 1.3.4.6666)
# category: GeniusLoci.Element
# Delete the input list of elements from the given Revit document.
# The node returns the number of successfully deleted elements and their Ids as a string.
# Based on a Springs node

element = Input()
document = Input(document : var[]..[] = null)  # Use only if you want to query a document
python_script = Python(IN[0]=element, IN[1]=document)
# ---------- python_script.python (47 lines) ----------
#Copyright(c) 2016, Dimitar Venkov
# @5devene, dimitar.ven@gmail.com

import clr
clr.AddReference('RevitAPI')
from Autodesk.Revit.DB import*
clr.AddReference('RevitServices')
import RevitServices
from RevitServices.Persistence import DocumentManager
from RevitServices.Transactions import TransactionManager

def tolist(obj1):
	if hasattr(obj1,"__iter__"): return obj1
	else: return [obj1]

elems = UnwrapElement(tolist(IN[0]))
inputdocs = tolist(UnwrapElement(IN[1]))

#Part of script from Clockwork
for inputdoc in inputdocs :
	if inputdoc == None:
		doc = DocumentManager.Instance.CurrentDBDocument
	elif inputdoc.GetType().ToString() == "Autodesk.Revit.DB.Document":
		doc = inputdoc
	elif inputdoc.GetType().ToString() == "Autodesk.Revit.DB.RevitLinkInstance":
		doc = inputdoc.GetLinkDocument()
	else: doc = None
	
	TransactionManager.Instance.ForceCloseTransaction()
	t = Transaction(doc,'delete')
	t.Start()

deleted, failed = [], []

for e in elems:
	id = None
	try:
		id = e.Id
		del_id = doc.Delete(id)
		deleted.extend([d.ToString() for d in del_id])
	except:
		if id is not None:
			failed.append(id.ToString() )
s = set(deleted)
failed1 = [x for x in failed if x not in s]
t.Commit()
OUT = len(deleted), ';'.join(deleted), ';'.join(failed1)
# ----------------------------------------
code_block = CodeBlock(d=python_script) { d[0]; d[1]; d[2]; }
count = Output(code_block.out0)
deletedIds_str = Output(code_block.out1)  # "deletedIds(str)"
failedIds_str = Output(code_block.out2)  # "failedIds(str)"
