# Dynamo custom node Display Units.dyf (Dynamo 2.12.0.5650)
# category: GeniusLoci.Utilities
# Enumerate the UnitTypes and the UnitGroups and returns their DisplayUnitTypes and UnitSymbols associated.

display_units = Python()  # IronPython2
# ---------- display_units.python (67 lines) ----------
#Alban de Chasteigner 2018
#twitter : @geniusloci_bim
#geniusloci.bim@gmail.com

import clr
clr.AddReference("RevitServices")
import RevitServices
from RevitServices.Persistence import DocumentManager
uiapp = DocumentManager.Instance.CurrentUIApplication
app = uiapp.Application
version=int(app.VersionNumber)

clr.AddReference("RevitAPI")
import Autodesk
from Autodesk.Revit.DB import *

units,groups,dispunits,validUnits,dispsyms=[],[],[],[],[]

if version < 2021:
	units = UnitUtils.GetValidUnitTypes()
	for unit in units :
		group=UnitUtils.GetUnitGroup(unit)
		groups.append(group)
		dispunit = UnitUtils.GetValidDisplayUnits(unit)
		dispunits.append(dispunit)

	for dispuni in dispunits :
		unitSymbTy,dispsyms=[],[]
		for dispun in dispuni:
			unitSymbType=FormatOptions.GetValidUnitSymbols(dispun)
			unitSymbTy.append(unitSymbType)
		validUnits.append(unitSymbTy)
		for unitsymbol in validUnits:
			symbs=[]
			for unitsymb in unitsymbol :
				for unitsy in unitsymb :
					if unitsy == UnitSymbolType.UST_NONE:
						dispsym = None
					else:
						dispsym = LabelUtils.GetLabelFor(unitsy)
					symbs.append(dispsym)
			dispsyms.append(filter(None,symbs))
else:
	if version >= 2023:
		identifiers = UnitUtils.GetAllMeasurableSpecs()
	else:
		identifiers = UnitUtils.GetAllSpecs()
	for id in identifiers:
		units.append(UnitUtils.GetTypeCatalogStringForSpec(id))
		if version >= 2022:
			groups.append(LabelUtils.GetLabelForDiscipline(UnitUtils.GetDiscipline(id)))
		else:
			groups.append(UnitUtils.GetUnitGroup(id))
		validUnits.append(UnitUtils.GetValidUnits(id))
	for vali in validUnits :
		dispunit,symbs=[],[]
		for val in vali:
			dispunit.append(UnitUtils.GetTypeCatalogStringForUnit(val))
			unitSymbType=FormatOptions.GetValidSymbols(val)
			for unitSymb in unitSymbType:
				try:dispSym = LabelUtils.GetLabelForSymbol(unitSymb)
				except:dispSym = None
				symbs.append(dispSym)	
		dispunits.append(dispunit)
		dispsyms.append(filter(None,symbs))

OUT = units, groups,dispunits,dispsyms
# ----------------------------------------
code_block = CodeBlock(x=display_units) { x[0]; x[1]; x[2]; x[3]; }
UnitType = Output(code_block.out0)
UnitGroup = Output(code_block.out1)
DisplayUnitType = Output(code_block.out2)
UnitSymbol = Output(code_block.out3)
