# Dynamo custom node Document Units.dyf (Dynamo 2.16.2.5624)
# category: GeniusLoci.Document
# Retrieves the unit types of a given document.

docOrRevitLinkInstance = Input(docOrRevitLinkInstance: var[] = null)  # Use only if you want to query a linked model
python_script = Python(IN[0]=docOrRevitLinkInstance)  # IronPython2
# ---------- python_script.python (55 lines) ----------
#Alban de Chasteigner 2020
#twitter : @geniusloci_bim
#geniusloci.bim@gmail.com
#https://github.com/albandechasteigner/GeniusLociForDynamo

import clr
clr.AddReference("RevitServices")
import RevitServices 
from RevitServices.Persistence import DocumentManager
uiapp = DocumentManager.Instance.CurrentUIApplication
app = uiapp.Application
version=int(app.VersionNumber)

clr.AddReference('RevitAPI')
import Autodesk
from Autodesk.Revit.DB import *

inputdocs = UnwrapElement(IN[0]) if isinstance(IN[0],list) else [UnwrapElement(IN[0])]
results=[]

def DocUnits(inputdoc) :
	if inputdoc == None:
		doc = DocumentManager.Instance.CurrentDBDocument
	elif isinstance(inputdoc, Document):
		doc = inputdoc
	elif isinstance(inputdoc, RevitLinkInstance):
		doc = inputdoc.GetLinkDocument()
		
	if version < 2021:
		unitTypes = [UnitType.UT_Angle, UnitType.UT_Area, UnitType.UT_Length,UnitType.UT_MassDensity, UnitType.UT_Slope, UnitType.UT_Volume, UnitType.UT_Currency]
		for unitType in unitTypes:
			formatOption = doc.GetUnits().GetFormatOptions(unitType)
			dispUnit = formatOption.DisplayUnits
			symType = formatOption.UnitSymbol
			if symType == UnitSymbolType.UST_NONE:
				dispSym = None
			else:
				dispSym = LabelUtils.GetLabelFor(symType)
			results.append([dispUnit,dispSym])
	else:
		unitTypes = [SpecTypeId.Angle, SpecTypeId.Area, SpecTypeId.Length,SpecTypeId.MassDensity, SpecTypeId.Slope, SpecTypeId.Volume, SpecTypeId.Currency, SpecTypeId.Speed,SpecTypeId.Time]
		for unitType in unitTypes:
			formatOption = doc.GetUnits().GetFormatOptions(unitType)
			symUnit = formatOption.GetUnitTypeId()
			symType = formatOption.GetSymbolTypeId()
			try:dispSym = LabelUtils.GetLabelForSymbol(symType)
			except:dispSym = None
			dispUnit = LabelUtils.GetLabelForUnit(symUnit)
			results.append([dispUnit,dispSym])
			
	results.append(doc.DisplayUnitSystem.ToString())
	results.append(doc.Title)	
	return results

OUT = DocUnits(inputdocs[0])
# ----------------------------------------
code_block = CodeBlock(x=python_script) { x[0]; x[1]; x[2]; x[3]; x[4]; x[5]; x[6]; x[7]; x[8]; x[9]; x[10]; }
Angle = Output(code_block.out0)
Area = Output(code_block.out1)
Length = Output(code_block.out2)
MassDensity = Output(code_block.out3)
Slope = Output(code_block.out4)
Volume = Output(code_block.out5)
Currency = Output(code_block.out6)
Speed = Output(code_block.out7)
Time = Output(code_block.out8)
UnitSystem = Output(code_block.out9)
FileName = Output(code_block.out10)
