# Dynamo custom node Documents Properties.dyf (Dynamo 1.3.4.6666)
# category: GeniusLoci.Document
# Queries the document properties.

docOrRevitLinkInstance = Input(docOrRevitLinkInstance : var[]..[] = null)  # Autodesk.Revit.DB.Document or RevitLinkInstance
python_script = Python(IN[0]=docOrRevitLinkInstance)
# ---------- python_script.python (38 lines) ----------
#Alban de Chasteigner 2020
#twitter : @geniusloci_bim
#geniusloci.bim@gmail.com
#https://github.com/albandechasteigner/GeniusLociForDynamo

import clr
clr.AddReference('RevitAPI')
from Autodesk.Revit.DB import *
clr.AddReference('RevitServices')
import RevitServices
from RevitServices.Persistence import DocumentManager

docs=UnwrapElement(IN[0]) if isinstance(IN[0],list) else [UnwrapElement(IN[0])]

titles,paths,linked,workshared,central,fams,version,number = [],[],[],[],[],[],[],[]

for d in docs:
	if d==None:
		doc=DocumentManager.Instance.CurrentDBDocument
	elif isinstance(d,RevitLinkInstance):
		doc=d.GetLinkDocument()
	else:
		doc=d
	titles.append(doc.Title)
	paths.append(doc.PathName)
	fams.append(doc.IsFamilyDocument)
	linked.append(doc.IsLinked)
	workshared.append(doc.IsWorkshared)
	if doc.IsWorkshared:
		cPath = doc.GetWorksharingCentralModelPath()
		central.append(ModelPathUtils.ConvertModelPathToUserVisiblePath(cPath))
	else:
		central.append(None)
	version.append(doc.Application.VersionNumber)
	number.append(Document.GetDocumentVersion(doc).NumberOfSaves)

if isinstance(IN[0], list): OUT = titles,paths,fams,linked,workshared,central,version,number
else: OUT = titles[0],paths[0],fams[0],linked[0],workshared[0],central[0],version[0],number[0]
# ----------------------------------------
code_block = CodeBlock(x=python_script) { x[0]; x[1]; x[2]; x[3]; x[4]; x[5]; x[6]; x[7]; }
FileName = Output(code_block.out0)
FilePath = Output(code_block.out1)
IsFamilyDocument = Output(code_block.out2)
IsLinked = Output(code_block.out3)
IsWorkshared = Output(code_block.out4)
CentralPath = Output(code_block.out5)  # If any
RevitVersion = Output(code_block.out6)
NumberOfSaves = Output(code_block.out7)
