# Dynamo custom node Element Change Level.dyf (Dynamo 1.3.4.6666)
# category: GeniusLoci.Level
# Change the element to the selected level without moving the element.
# Doesn't work with hosted family (Wall Based) and Work Plane based family (without Reference Level or with read-only Schedule Level).

element = Input()
level = Input()
python_script = Python(IN[0]=element, IN[1]=level)
# ---------- python_script.python (104 lines) ----------
#Alban de Chasteigner 2020
#twitter : @geniusloci_bim
#geniusloci.bim@gmail.com

import clr
clr.AddReference('RevitAPI')
import Autodesk
from Autodesk.Revit.DB import *

clr.AddReference('RevitServices')
import RevitServices
from RevitServices.Persistence import DocumentManager
from RevitServices.Transactions import TransactionManager
doc = DocumentManager.Instance.CurrentDBDocument

element = UnwrapElement(IN[0]) if isinstance(IN[0],list) else [UnwrapElement(IN[0])]
ref_level = UnwrapElement(IN[1])
result = []

TransactionManager.Instance.EnsureInTransaction(doc)
for x in element:
	ref_levelid = ref_level.Id
	if x.ToString() == 'Autodesk.Revit.DB.Wall' or x.ToString() == "Autodesk.Revit.DB.Opening":
		object_param_level =  x.get_Parameter(BuiltInParameter.WALL_BASE_CONSTRAINT)
		object_param_offset = x.get_Parameter(BuiltInParameter.WALL_BASE_OFFSET)
	elif x.ToString() == 'Autodesk.Revit.DB.Floor':
		object_param_level =  x.get_Parameter(BuiltInParameter.LEVEL_PARAM)
		object_param_offset = x.get_Parameter(BuiltInParameter.FLOOR_HEIGHTABOVELEVEL_PARAM)
	elif x.ToString() == 'Autodesk.Revit.DB.RoofBase' or x.ToString() == 'Autodesk.Revit.DB.FootPrintRoof':
		object_param_level =  x.get_Parameter(BuiltInParameter.ROOF_BASE_LEVEL_PARAM)
		object_param_offset = x.get_Parameter(BuiltInParameter.ROOF_LEVEL_OFFSET_PARAM)
	elif x.ToString() == 'Autodesk.Revit.DB.ExtrusionRoof':
		object_param_level =  x.get_Parameter(BuiltInParameter.ROOF_CONSTRAINT_LEVEL_PARAM)
		object_param_offset = x.get_Parameter(BuiltInParameter.ROOF_CONSTRAINT_OFFSET_PARAM)
	elif x.ToString() == 'Autodesk.Revit.DB.RoofBase' or x.ToString() == 'Autodesk.Revit.DB.FaceWall':
		object_param_level =  x.get_Parameter(BuiltInParameter.FACEROOF_LEVEL_PARAM)
		object_param_offset = x.get_Parameter(BuiltInParameter.FACEROOF_OFFSET_PARAM)
	elif x.ToString() == 'Autodesk.Revit.DB.Ceiling':
		object_param_level =  x.get_Parameter(BuiltInParameter.LEVEL_PARAM)
		object_param_offset = x.get_Parameter(BuiltInParameter.CEILING_HEIGHTABOVELEVEL_PARAM)
	elif x.ToString() == 'Autodesk.Revit.DB.Group':
		object_param_level =  x.get_Parameter(BuiltInParameter.GROUP_LEVEL)
		object_param_offset = x.get_Parameter(BuiltInParameter.GROUP_OFFSET_FROM_LEVEL)
	elif x.ToString() == 'Autodesk.Revit.DB.Architecture.Railing':
		object_param_level =  x.get_Parameter(BuiltInParameter.STAIRS_RAILING_BASE_LEVEL_PARAM)
		object_param_offset = x.get_Parameter(BuiltInParameter.STAIRS_RAILING_HEIGHT_OFFSET)
	elif x.ToString() == "Autodesk.Revit.DB.Architecture.Stairs" or x.Category.Id == ElementId(BuiltInCategory.OST_Ramps):
		object_param_level =  x.get_Parameter(BuiltInParameter.STAIRS_BASE_LEVEL_PARAM)
		object_param_offset = x.get_Parameter(BuiltInParameter.STAIRS_BASE_OFFSET)
	elif x.Category.Id == ElementId(BuiltInCategory.OST_StructuralColumns):
		object_param_level =  x.get_Parameter(BuiltInParameter.FAMILY_BASE_LEVEL_PARAM)
		object_param_offset = x.get_Parameter(BuiltInParameter.SCHEDULE_BASE_LEVEL_OFFSET_PARAM)
	#BuildingPads
	elif isinstance(x, Autodesk.Revit.DB.Architecture.BuildingPad):
		#Read-Only BIP
		#object_param_level = x.get_Parameter(BuiltInParameter.SCHEDULE_LEVEL_PARAM)
		if x.LookupParameter("Level") != None :
			object_param_level = x.LookupParameter("Level")
		elif x.LookupParameter("Niveau") != None :
			object_param_level = x.LookupParameter("Niveau")
		object_param_offset = x.get_Parameter(BuiltInParameter.BUILDINGPAD_HEIGHTABOVELEVEL_PARAM)
	#Familyinstances without Schedule Level
	elif hasattr(x, "Symbol") and doc.GetElement(x.get_Parameter(BuiltInParameter.INSTANCE_SCHEDULE_ONLY_LEVEL_PARAM).AsElementId()) == None :	
		try:
			object_param_level = x.get_Parameter(BuiltInParameter.FAMILY_LEVEL_PARAM)
			object_param_offset = x.get_Parameter(BuiltInParameter.INSTANCE_FREE_HOST_OFFSET_PARAM)
		except:
			pass			
	try:
		object_level = doc.GetElement(object_param_level.AsElementId())
		object_newoffset = object_param_offset.AsDouble() + object_level.Elevation - ref_level.Elevation
		object_param_level.Set(ref_levelid)
		object_param_offset.Set(object_newoffset)
	except:
		pass
		
	#System families
	if hasattr(x, "ConnectorManager") :
		object_param_level = x.get_Parameter(BuiltInParameter.RBS_START_LEVEL_PARAM)
	elif x.Category.Id == ElementId(BuiltInCategory.OST_StructuralFraming):
		object_param_level =  x.get_Parameter(BuiltInParameter.INSTANCE_REFERENCE_LEVEL_PARAM)
		if x.get_Parameter(BuiltInParameter.STRUCTURAL_BEAM_END0_ELEVATION) != None and x.get_Parameter(BuiltInParameter.STRUCTURAL_BEAM_END0_ELEVATION).AsDouble() == 0  :
			try :
				newoffset = (x.get_Parameter(BuiltInParameter.STRUCTURAL_BEAM_END0_ELEVATION)).Set(x.get_Parameter(BuiltInParameter.STRUCTURAL_BEAM_END0_ELEVATION).AsDouble()+1)
				object_newoffset = (x.get_Parameter(BuiltInParameter.STRUCTURAL_BEAM_END0_ELEVATION)).Set(x.get_Parameter(BuiltInParameter.STRUCTURAL_BEAM_END0_ELEVATION).AsDouble()-1)
			except:
				pass
	elif x.ToString() == 'Autodesk.Revit.DB.Structure.Truss':
		object_param_level =  x.get_Parameter(BuiltInParameter.TRUSS_ELEMENT_REFERENCE_LEVEL_PARAM)
		if round(x.get_Parameter(BuiltInParameter.TRUSS_ELEMENT_END0_ELEVATION).AsDouble(),10) == 0 :
			newoffset = (x.get_Parameter(BuiltInParameter.TRUSS_ELEMENT_END0_ELEVATION)).Set(x.get_Parameter(BuiltInParameter.TRUSS_ELEMENT_END0_ELEVATION).AsDouble()+1)
			object_newoffset = (x.get_Parameter(BuiltInParameter.TRUSS_ELEMENT_END0_ELEVATION)).Set(x.get_Parameter(BuiltInParameter.TRUSS_ELEMENT_END0_ELEVATION).AsDouble()-1)
	#Familyinstances with Schedule Level
	elif hasattr(x, "Symbol") and doc.GetElement(x.get_Parameter(BuiltInParameter.INSTANCE_SCHEDULE_ONLY_LEVEL_PARAM).AsElementId()) != None :
		object_param_level = x.get_Parameter(BuiltInParameter.INSTANCE_SCHEDULE_ONLY_LEVEL_PARAM)
		
	try:
		object_param_level.Set(ref_levelid)
		result.append(x)
	except:
		result.append(False)
TransactionManager.Instance.TransactionTaskDone()

OUT = result
# ----------------------------------------
Result = Output(python_script)
