# Dynamo custom node Element GetRotation.dyf (Dynamo 1.3.4.6666)
# category: GeniusLoci.Element
# Calculates the rotation angle between the given element and the X axis.
# Works for point, line, sketch based elements and link instances.

element = Input()  # element or Dynamo line
python_script = Python(IN[0]=element)
# ---------- python_script.python (66 lines) ----------
#Alban de Chasteigner 2020
#twitter : @geniusloci_bim
#geniusloci.bim@gmail.com
#https://github.com/albandechasteigner/GeniusLociForDynamo

import clr
import math
clr.AddReference('RevitAPI')
import Autodesk
from Autodesk.Revit.DB import *
clr.AddReference('RevitNodes')
import Revit
clr.ImportExtensions(Revit.GeometryConversion)

items = UnwrapElement(IN[0]) if isinstance(IN[0],list) else [UnwrapElement(IN[0])]

def GetRotation(item):
	# Dynamo lines
	if hasattr(item, "Explode"):
		vector = item.ToRevitType().Direction
		rotationAngle = math.degrees(vector.AngleTo(XYZ.BasisX))
	elif hasattr(item, "Location"):
		loc = item.Location
		if loc:	
			# Annotation symbol, importInstance and linkInstance
			if hasattr(item, "GetTotalTransform"):
				trans=item.GetTotalTransform()
				rotationAngle = math.degrees(trans.BasisX.AngleOnPlaneTo(XYZ.BasisX, XYZ.BasisZ))
			# point-based elements (e.g. most loadable families)
			elif isinstance(loc,LocationPoint):
				if hasattr(loc, "Rotation"):
					rotationAngle = math.degrees(loc.Rotation)
				# Group, assembly
				else:rotationAngle = 0
			# line-based elements (e.g. walls)
			elif isinstance(loc,LocationCurve):
				vector = loc.Curve.Direction
				rotationAngle = math.degrees(vector.AngleTo(XYZ.BasisX))
			else:
				# sketch-based elements (ceiling, floor and roof)
				if hasattr(item, "FindInserts"):
					for ref in HostObjectUtils.GetTopFaces(item):
						geomFace=item.GetGeometryObjectFromReference(ref)
						#Get BoundingBox max UV point
						maxUV = geomFace.GetBoundingBox().Max
						#Get transform
						trans=geomFace.ComputeDerivatives(maxUV)
						if isinstance(item,Ceiling):
							rotationAngle = math.degrees(abs(trans.BasisZ.AngleOnPlaneTo(XYZ.BasisX, XYZ.BasisZ)-2*math.pi))
						else:
							rotationAngle = math.degrees(abs(trans.BasisY.AngleOnPlaneTo(XYZ.BasisX, XYZ.BasisZ)-math.pi))
				else:
					rotationAngle=0
		else:
			rotationAngle=0
	if rotationAngle==180:
		rotationAngle=0
	elif rotationAngle>180:
		rotationAngle=abs(rotationAngle-360)
	else:
		rotationAngle
	return round(rotationAngle,3)
	
rotations = [GetRotation(x) for x in items]

OUT = rotations
# ----------------------------------------
Degree = Output(python_script)  # Angle
