# Dynamo custom node Element LocationCurve.dyf (Dynamo 1.3.4.6666)
# category: GeniusLoci.Geometry
# Gets the curve geometry from the element.

element = Input()
python_script = Python(IN[0]=element)
# ---------- python_script.python (142 lines) ----------
#Alban de Chasteigner 2020
#twitter : @geniusloci_bim
#geniusloci.bim@gmail.com

import clr
clr.AddReference('RevitAPI')
import Autodesk
from Autodesk.Revit.DB import *

clr.AddReference("RevitNodes")
import Revit
clr.ImportExtensions(Revit.GeometryConversion)

clr.AddReference("RevitServices")
import RevitServices
from RevitServices.Persistence import DocumentManager
from RevitServices.Transactions import TransactionManager
uiapp = DocumentManager.Instance.CurrentUIApplication
app = uiapp.Application
version=int(app.VersionNumber)

items = UnwrapElement(IN[0]) if isinstance(IN[0],list) else [UnwrapElement(IN[0])]
curves = []

def Curve(dimension):
	curve = []
	if dimension.DimensionShape == DimensionShape.Linear:
		direction = dimension.Curve.Direction
		if dimension.NumberOfSegments ==0:
			start = dimension.Origin.Subtract(direction.Multiply(dimension.Value/2))
			end = dimension.Origin.Subtract(direction.Multiply(-dimension.Value/2))
			curve=Line.CreateBound(start,end).ToProtoType()
		else:
			for segment in dimension.Segments:
				start = segment.Origin.Subtract(direction.Multiply(segment.Value/2))
				end = segment.Origin.Subtract(direction.Multiply(-segment.Value/2))
				curve.append(Line.CreateBound(start,end).ToProtoType())
	return curve
	
def getCurve(section):
	#Thanks to Fair59 https://forums.autodesk.com/t5/revit-api-forum/how-can-i-get-the-coordinates-of-the-endpoints-for-a-section/td-p/6877871
	correction = 21.130014403 / 304.8
	#Get the section view from the Section Marker
	if ElementId(BuiltInCategory.OST_Viewers) == section.Category.Id :
		viewSection = doc.GetElement(ElementId(section.Id.IntegerValue + 1))
		marker=section
	#Get the Section Marker from the section view
	elif isinstance(section,Autodesk.Revit.DB.ViewSection):
		marker = doc.GetElement(ElementId(section.Id.IntegerValue - 1))
		viewSection=section

	if marker and viewSection:
		vType = doc.GetElement(marker.GetTypeId())
		if vType:
			TransactionManager.Instance.EnsureInTransaction(doc)
			trans = Autodesk.Revit.DB.SubTransaction(doc)
			trans.Start()
			par = vType.get_Parameter(BuiltInParameter.SECTION_TAG)
			par.Set( ElementId.InvalidElementId)
			par = vType.get_Parameter(BuiltInParameter.VIEWER_REFERENCE_LABEL_TEXT)
			par.Set("")
			view.Scale = 1
			doc.Regenerate()
			bb1 = marker.get_BoundingBox(view)
			trans.RollBack()
			TransactionManager.Instance.ForceCloseTransaction()

			bb = marker.get_BoundingBox(view)
			if bb:
				pt1 = bb.Min
				pt2 = bb.Max
				if bb1 :
					pt1 = bb1.Min
					pt2 = bb1.Max
	
				Origin = viewSection.Origin
				ViewBasisX = viewSection.RightDirection
				ViewBasisY = viewSection.ViewDirection
				if ViewBasisX.X < 0 != ViewBasisX.Y < 0 :
					d = pt1.Y
					pt1 = XYZ( pt1.X, pt2.Y, pt1.Z)
					pt2 = XYZ( pt2.X, d, pt2.Z)

				ToPlane1 = pt1.Add(ViewBasisY.Multiply(ViewBasisY.DotProduct(Origin.Subtract(pt1))))
				ToPlane2 = pt2.Subtract(ViewBasisY.Multiply(ViewBasisY.DotProduct(pt2.Subtract(Origin))))
				correctionVector = ToPlane2.Subtract( ToPlane1 ).Normalize().Multiply(correction)
				endPoint0 = ToPlane1.Add(correctionVector)
				endPoint1 = ToPlane2.Subtract(correctionVector)
				curve=Line.CreateBound(endPoint0,endPoint1).ToProtoType()
				return curve

def colCurve(col):	
	loc= col.Location.Point
	bb = col.get_BoundingBox(None).Min
	height=col.get_Parameter(BuiltInParameter.INSTANCE_LENGTH_PARAM).AsDouble()
	start=XYZ(loc.X,loc.Y,bb.Z)
	end=XYZ(start.X,start.Y,start.Z+height)
	curve=Line.CreateBound(start,end).ToProtoType()
	return curve

for item in items:
	doc=item.Document
	view = doc.ActiveView
	#Railing
	if hasattr(item, "GetPath"):
		curves.append([railpath.ToProtoType() for railpath in item.GetPath()])
	#Revision Cloud
	elif hasattr(item, "GetSketchCurves"): 
		curves.append([sk.ToProtoType() for sk in item.GetSketchCurves()])
	elif hasattr(item, "LocationCurve"): 
		curves.append(item.LocationCurve.ToProtoType())
	elif hasattr(item, "FullCurve"): 
		curves.append(item.FullCurve.ToProtoType())
	elif hasattr(item, "ValueOverride"):
		curves.append(Curve(item))
	elif hasattr(item, "Curve"): 
		curves.append(item.Curve.ToProtoType())
	elif hasattr(item, "GeometryCurve"): 		
		curves.append(item.GeometryCurve.ToProtoType())
	elif hasattr(item, "GetEndpoint"): 
		curves.append(item.ToProtoType())
	elif version > 2019 and isinstance(item,Autodesk.Revit.DB.Analysis.PathOfTravel):
		curves.append([i.ToProtoType() for i in item.GetCurves()])
	elif ElementId(BuiltInCategory.OST_StructuralColumns) == item.Category.Id and not item.IsSlantedColumn :
		curves.append(colCurve(item))
	elif hasattr(item, "GetCurvesInView"):
		for crv in item.GetCurvesInView(DatumExtentType.ViewSpecific,view):
			curves.append(crv.ToProtoType())
	elif ElementId(BuiltInCategory.OST_Viewers) == item.Category.Id or isinstance(item,Autodesk.Revit.DB.ViewSection):
		curves.append(getCurve(item))
	elif hasattr(item, "Location"):
		loc = item.Location
		if isinstance(loc,Autodesk.Revit.DB.LocationCurve):
			curves.append(loc.Curve.ToProtoType())
		else:
			curves.append(None)
	else: curves.append(None)

if isinstance(IN[0], (list)): OUT = curves
elif hasattr(item, "GetPath"): OUT = curves
elif hasattr(item, "ValueOverride"): OUT = curves
else: OUT = curves[0]
# ----------------------------------------
Curve = Output(python_script)
