# Dynamo custom node Element Points References.dyf (Dynamo 1.3.4.6666)
# category: GeniusLoci.Reference
# Returns the references to the start and the end points of the curve based element.

element = Input()  # Curve based element
python_script = Python(IN[0]=element)
# ---------- python_script.python (40 lines) ----------
import clr
clr.AddReference('RevitAPI')
import Autodesk
from Autodesk.Revit.DB import *

clr.AddReference('RevitNodes')
import Revit
clr.ImportExtensions(Revit.GeometryConversion)
clr.ImportExtensions(Revit.Elements)
from Revit.Elements import *

clr.AddReference('RevitServices')
import RevitServices
from RevitServices.Persistence import DocumentManager

doc = DocumentManager.Instance.CurrentDBDocument

items = UnwrapElement(IN[0])
if not hasattr(items, '__iter__'):
	items = [items]
	
allReferences,allPoints =[],[]

opt = Options()
opt.ComputeReferences = True
opt.IncludeNonVisibleObjects = True
opt.View = doc.ActiveView
for item in items:
	references = ReferenceArray()
	points=[]
	for obj in item.get_Geometry(opt):
		if isinstance(obj, Line):
			gline = obj
			references=gline.GetEndPointReference(0),gline.GetEndPointReference(1)
			points=gline.GetEndPoint(0).ToPoint(),gline.GetEndPoint(1).ToPoint()
	allReferences.append(references)
	allPoints.append(points)

if isinstance(IN[0], (list)): OUT = allPoints,allReferences
else: OUT = allPoints[0],allReferences[0]
# ----------------------------------------
code_block = CodeBlock(x=python_script) { x[0]; x[1]; }
Points = Output(code_block.out0)
References = Output(code_block.out1)
