# Dynamo custom node Element TaggedStatus.dyf (Dynamo 2.12.0.5650)
# category: GeniusLoci.Tag
# Identify the tagged and untagged elements.
# Please note : This doesn't work with areas and spaces.

element = Input(element: var[]..[])
python_script = Python(IN[0]=element)  # IronPython2
# ---------- python_script.python (39 lines) ----------
#Alban de Chasteigner 2018
#twitter : @geniusloci_bim
#geniusloci.bim@gmail.com
import clr
clr.AddReference("RevitServices")
import RevitServices
from RevitServices.Persistence import DocumentManager
clr.AddReference("RevitAPI")
import Autodesk
from Autodesk.Revit.DB import FilteredElementCollector,IndependentTag,BuiltInCategory
uiapp = DocumentManager.Instance.CurrentUIApplication
app = uiapp.Application
version=int(app.VersionNumber)
doc = DocumentManager.Instance.CurrentDBDocument

elements = UnwrapElement(IN[0]) if isinstance(IN[0],list) else [UnwrapElement(IN[0])]

tagged,notTagged = [], []

collector = FilteredElementCollector(doc,doc.ActiveView.Id).OfClass(IndependentTag).ToElements()
collector2 = FilteredElementCollector(doc,doc.ActiveView.Id).OfCategory(BuiltInCategory.OST_RoomTags).ToElements()

for elem in elements:
	isTagged = False
	for t in collector:
		if version < 2022:
			if t.TaggedLocalElementId == elem.Id:
				isTagged = True
		else:
			if [doc.GetElement(x) for x in t.GetTaggedLocalElementIds()] == elem.Id:
				isTagged = True
	for t in collector2:
		if t.TaggedLocalRoomId == elem.Id:
			isTagged = True
	if not isTagged :
		notTagged.append(elem)
	else: tagged.append(elem)

OUT = tagged,notTagged
# ----------------------------------------
code_block = CodeBlock(x=python_script) { x[0]; x[1]; }
Tagged = Output(code_block.out0)
NotTagged = Output(code_block.out1)
