# Dynamo custom node Element to Document.dyf (Dynamo 1.3.4.6666)
# category: GeniusLoci.Element
# Returns the Document in which the Element resides, the document's filename and filepath.

element = Input()
python_script = Python(IN[0]=element)
# ---------- python_script.python (16 lines) ----------
import clr
clr.AddReference('RevitAPI')
from Autodesk.Revit.DB import *
clr.AddReference('RevitServices')
import RevitServices
from RevitServices.Persistence import DocumentManager

elements = UnwrapElement(IN[0]) if isinstance(IN[0],list) else [UnwrapElement(IN[0])]

docs,titles = [],[]
for element in elements:
    docs.append(element.Document)
    titles.append(element.Document.Title)

if isinstance(IN[0], (list)): OUT = docs,titles
else: OUT = docs[0],titles[0]
# ----------------------------------------
code_block = CodeBlock(x=python_script) { x[0]; x[1]; }
Document = Output(code_block.out0)
FileName = Output(code_block.out1)
