# Dynamo custom node Enum JoinType.dyf (Dynamo 1.3.4.6666)
# category: GeniusLoci.CompoundStructure
# Enumerate the type of join at the end of an element. Use with Set Wall JoinType node

python_script = Python()
# ---------- python_script.python (10 lines) ----------
import clr
# Import RevitAPI
clr.AddReference("RevitAPI")
import Autodesk
from Autodesk.Revit.DB import *
from Autodesk.Revit.DB import Structure
import System

#Assign your output to the OUT variable
OUT = System.Enum.GetValues(Autodesk.Revit.DB.JoinType)
# ----------------------------------------
JoinType = Output(python_script)
