# Dynamo custom node Enumerate Calculations.dyf (Dynamo 1.3.4.6666)
# category: GeniusLoci.MEP
# Enumerates the calculations levels for the MEP system type.
# For use with the "Set SystemType Properties" node.

python_script = Python()
# ---------- python_script.python (7 lines) ----------
import clr
clr.AddReference("RevitAPI")
import Autodesk
from Autodesk.Revit.DB import Mechanical
import System

OUT = System.Enum.GetValues(Autodesk.Revit.DB.Mechanical.SystemCalculationLevel)
# ----------------------------------------
Calculations = Output(python_script)
