# Dynamo custom node Enumerate DWG export options.dyf (Dynamo 1.3.4.6666)
# category: GeniusLoci.CAD Export
# Enumerate Color mode, Autocad Version and Type of Units.

get_export_options = Python()
# ---------- get_export_options.python (7 lines) ----------
import clr
clr.AddReference("RevitAPI")
import Autodesk
from Autodesk.Revit.DB import *
import System

OUT = System.Enum.GetValues(Autodesk.Revit.DB.ExportColorMode),System.Enum.GetValues(Autodesk.Revit.DB.ACADVersion),System.Enum.GetValues(Autodesk.Revit.DB.ExportUnit)
# ----------------------------------------
code_block = CodeBlock(Option=get_export_options) { Option[0]; Option[1]; Option[2]; }
Colormode = Output(code_block.out0)
Autocad_Version = Output(code_block.out1)
Unit = Output(code_block.out2)
