# Dynamo custom node ExportPDF.dyf (Dynamo 2.13.1.3887)
# category: GeniusLoci.Export
# Works only in Revit 2022 and later.
# Exports a selection of views in PDF format.

DirectoryPath = Input(DirectoryPath: var[]..[])
view = Input(view: var[]..[])
Filename = Input(Filename: string[]..[])
Combine = Input(Combine: bool = false)  # Combine into a single file ?
Raster = Input(Raster: bool = false)  # Raster or vector processing ?
export_pdf = Python(IN[0]=DirectoryPath, IN[1]=view, IN[2]=Filename, IN[3]=Combine, IN[4]=Raster)  # IronPython2
# ---------- export_pdf.python (52 lines) ----------
#Inspired by Sean Page, 2022 https://forum.dynamobim.com/t/export-pdf-in-revit-2022-quick-example/62697
import clr
clr.AddReference('RevitAPI')
from Autodesk.Revit.DB import *

clr.AddReference('System')
from System.Collections.Generic import List

clr.AddReference('RevitServices')
import RevitServices
from RevitServices.Persistence import DocumentManager
doc = DocumentManager.Instance.CurrentDBDocument

Folder = IN[0]
sheets = UnwrapElement(IN[1]) if isinstance(IN[1],list) else [UnwrapElement(IN[1])]
names = IN[2] if isinstance(IN[2],list) else [IN[2]]
result = []

opts = PDFExportOptions()
opts.ExportQuality = PDFExportQualityType.DPI600
#This will use the TitleBlock size to create the sheet size
opts.PaperFormat = ExportPaperFormat.Default
#This will use a specific size for every view exported
#opts.PaperFormat = ExportPaperFormat.ARCH_E1
opts.ZoomType = ZoomType.Zoom
opts.AlwaysUseRaster = IN[4]
opts.ZoomPercentage = 100
opts.HideCropBoundaries = True
opts.HideReferencePlane = True
opts.HideScopeBoxes = True
opts.HideUnreferencedViewTags = True
opts.MaskCoincidentLines = True
opts.ViewLinksInBlue = False
opts.ColorDepth = ColorDepthType.Color
#Don't think of this as a "continue" but rather as a silent mode
opts.StopOnError = False
#Make sure to not use these settings as they don't work if 'Default' size is used above
#opts.PaperPlacement = PaperPlacementType.LowerLeft

if IN[3] == True:
	opts.Combine = True
	opts.FileName = names[0]
	sheetId = List[ElementId](x.Id for x in sheets)
	result=doc.Export(Folder,sheetId,opts)
else:
	for sheet,name in zip(sheets,names):
		opts.FileName = name
		sheetId = List[ElementId]()
		sheetId.Add(sheet.Id)
		result.append(doc.Export(Folder,sheetId,opts))
	
OUT = result
# ----------------------------------------
Succeed = Output(export_pdf)
