# Dynamo custom node Family Document Close.dyf (Dynamo 1.3.4.6666)
# category: GeniusLoci.Family
# Close the given document with the option to save the changes.

document = Input()
save = Input(save : bool=false)  # Save the open document ?
python_script = Python(IN[0]=document, IN[1]=save)
# ---------- python_script.python (25 lines) ----------
#Alban de Chasteigner 2020
#twitter : @geniusloci_bim
#geniusloci.bim@gmail.com

import clr
clr.AddReference("RevitAPI")
import Autodesk
from Autodesk.Revit.DB import *

clr.AddReference("RevitServices")
import RevitServices
from RevitServices.Transactions import TransactionManager

famDocs = IN[0] if isinstance(IN[0],list) else [IN[0]]
save=IN[1]
result=[]

TransactionManager.Instance.ForceCloseTransaction()
for famDoc in famDocs:
	try:
		result.append(famDoc.Close(save))
	except:
		result.append("Failed")
if isinstance(IN[0], list): OUT = result
else: OUT = result[0]
# ----------------------------------------
Closed = Output(python_script)  # "Closed?"
