# Dynamo custom node FamilyDocument Parameters.dyf (Dynamo 1.3.4.6666)
# category: GeniusLoci.Parameter
# Retrieves all family parameters from the given or active family document.

familydocument = Input(familydocument : var[]..[] = null)  # Use only to query a Family Document
familyParameters = Python(IN[0]=familydocument)  # "FamilyDocument.FamilyParameters"
# ---------- familyParameters.python (27 lines) ----------
#Based on a Clockwork node
import clr
clr.AddReference('RevitAPI')
import Autodesk
from Autodesk.Revit.DB import *

clr.AddReference("RevitServices")
import RevitServices
from RevitServices.Persistence import DocumentManager

inputdocs = UnwrapElement(IN[0]) if isinstance(IN[0],list) else [UnwrapElement(IN[0])]
paramlist,paramName=[],[]

for inputdoc in inputdocs :
	pList,pName = [],[]
	if inputdoc == None:
		doc = DocumentManager.Instance.CurrentDBDocument
	elif isinstance (inputdoc,Autodesk.Revit.DB.Document):
		doc = inputdoc
	else: doc = DocumentManager.Instance.CurrentDBDocument
	if doc.IsFamilyDocument:
		for param in doc.FamilyManager.Parameters:
			pList.append(param)
			pName.append(param.Definition.Name)
		paramlist.append(pList)
		paramName.append(pName)
OUT = paramlist,paramName
# ----------------------------------------
code_block = CodeBlock(x=familyParameters) { x[0]; x[1]; }
FamilyParameters = Output(code_block.out0)
ParameterNames = Output(code_block.out1)
