# Dynamo custom node FamilyInstance ByReference.dyf (Dynamo 1.3.4.6666)
# category: GeniusLoci.Family
# Inserts a new instance of a family onto a face referenced by the input Reference, using a location, reference direction, and a type/symbol.

familyType = Input()
reference = Input()  # Autodesk.Revit.DB.Reference
location = Input(location:Autodesk.DesignScript.Geometry.Point[]..[])  # Point where the instance is to be placed
referenceDirection = Input(referenceDirection:Autodesk.DesignScript.Geometry.Vector[]..[])  # A vector that defines the direction of placement of the instance
python_script = Python(IN[0]=familyType, IN[1]=reference, IN[2]=location, IN[3]=referenceDirection)
# ---------- python_script.python (43 lines) ----------
#Inspired by Springs package, Dimitar Venkov

import clr
clr.AddReference("RevitServices")
import RevitServices
from RevitServices.Persistence import DocumentManager
from RevitServices.Transactions import TransactionManager
doc = DocumentManager.Instance.CurrentDBDocument

clr.AddReference("RevitAPI")
import Autodesk

clr.AddReference("RevitNodes")
import Revit
clr.ImportExtensions(Revit.Elements)
clr.ImportExtensions(Revit.GeometryConversion)

def tolist(obj1):
	if hasattr(obj1,"__iter__"): return obj1
	else: return [obj1]

familyType, reference, locationPoint, refDirections = map(tolist, UnwrapElement(IN))
refDirection=[refDir.ToXyz(True) for refDir in refDirections]

OUT = []
ftp_len = len(familyType) == 1
ref_len = len(reference) == 1
dir_len = len(refDirection) == 1

TransactionManager.Instance.EnsureInTransaction(doc)
for i in xrange(len(locationPoint)):
	p = locationPoint[i].ToXyz(True)
	d = 0 if dir_len else i
	j = 0 if ftp_len else i
	k = 0 if ref_len else i
	try:
		if not familyType[j].IsActive : familyType[j].Activate()	
		nf = doc.Create.NewFamilyInstance(reference[k],p,refDirection[d],familyType[j])
		OUT.append(nf.ToDSType(False))
	except:
		OUT.append(None)

TransactionManager.Instance.TransactionTaskDone()
# ----------------------------------------
FamilyInstance = Output(python_script)
