# Dynamo custom node FamilyInstance Reference ByRefLine.dyf
# category: GeniusLoci.Reference
# Works only in Revit 2018.1 and later.
# Gets the reference corresponding to the given Reference Line in the family instance.

familyInstance = Input(familyInstance: var[]..[])
ReferenceType = Input(ReferenceType: var = null)  # Default = StrongReference
python = Python(IN[0]=familyInstance, IN[1]=ReferenceType)  # IronPython2
# ---------- python.python (23 lines) ----------
#Alban de Chasteigner 2018
#twitter : @geniusloci_bim
#geniusloci.bim@gmail.com

import clr

elements = UnwrapElement(IN[0]) if isinstance(IN[0],list) else [UnwrapElement(IN[0])]
reftype = UnwrapElement(IN[1])
references=[]

#Get Reference Lines from Families
for element in elements:
	if reftype == None:
		reference = element.GetReferences(FamilyInstanceReferenceType.StrongReference)
	else :
		reference = element.GetReferences(reftype)
	if len(reference) == 1:	
		references.append(reference[0])
	else:
		references.append(reference)

if len(references) == 1 : OUT = references[0]
else: OUT = references
# ----------------------------------------
Reference = Output(python)
