# Dynamo custom node FamilyInstance Reference ByType.dyf
# category: GeniusLoci.Reference
# Works only in Revit 2018.1 and later.
# Gets the reference corresponding to the given Reference Plane in the family instance.
# Also works with linked family instance.

familyInstance = Input(familyInstance: var[]..[])
ReferenceType = Input(ReferenceType: var = null)  # Default = Center (Left/Right)
python = Python(IN[0]=familyInstance, IN[1]=ReferenceType)  # IronPython2
# ---------- python.python (55 lines) ----------
#Alban de Chasteigner 2018
#twitter : @geniusloci_bim
#geniusloci.bim@gmail.com

import clr
clr.AddReference('RevitServices')
import RevitServices
from RevitServices.Persistence import DocumentManager
from RevitServices.Transactions import TransactionManager
doc = DocumentManager.Instance.CurrentDBDocument

clr.AddReference('RevitAPI')
import Autodesk
from Autodesk.Revit.DB import *

clr.AddReference('RevitNodes')
import Revit
clr.ImportExtensions(Revit.GeometryConversion)

elements = UnwrapElement(IN[0]) if isinstance(IN[0],list) else [UnwrapElement(IN[0])]
reftype = UnwrapElement(IN[1])
references,refnamelist,listPlane=[],[],[]

#Get Reference Planes from Families
for element in elements:
	if reftype == None:
		reference = element.GetReferences(FamilyInstanceReferenceType.CenterLeftRight)
	else :
		reference = element.GetReferences(reftype)
	refname,planeList=[],[]
	for ref in reference:
		refname.append(element.GetReferenceName(ref))
		try :
			TransactionManager.Instance.EnsureInTransaction(doc)
			trans1 = SubTransaction(doc)
			trans1.Start()
			sketch=SketchPlane.Create(doc,ref)
			plane = sketch.GetPlane().ToPlane(True)
			sketch.Dispose()
			trans1.RollBack()
			TransactionManager.Instance.TransactionTaskDone()
		except :
			plane=None
		planeList.append(plane)
	if len(reference) == 1:	
		references.append(reference[0])
		refnamelist.append(refname[0])
		listPlane.append(planeList[0])
	else:
		references.append(reference)
		refnamelist.append(refname)
		listPlane.append(planeList)

if len(references) == 1: OUT = references[0], refnamelist[0], listPlane[0]
else: OUT = references, refnamelist, listPlane
# ----------------------------------------
codeBlock = CodeBlock(x=python) { x[0]; x[1]; x[2]; }
Reference = Output(codeBlock.out0)
ReferenceName = Output(codeBlock.out1)
Plane = Output(codeBlock.out2)
