# Dynamo custom node FamilyInstance Symbolic Lines.dyf (Dynamo 2.13.1.3887)
# category: GeniusLoci.Family
# Obtains the symbolic lines of the family instance in the active view.
# (For example, the lines and the arcs of a door in a project plan view.)

familyInstance = Input(familyInstance: var[]..[])
python_script = Python(IN[0]=familyInstance)  # IronPython2
# ---------- python_script.python (53 lines) ----------
#Alban de Chasteigner 2019
#twitter : @geniusloci_bim
#geniusloci.bim@gmail.com

import clr
clr.AddReference("RevitAPI")
import Autodesk
from Autodesk.Revit.DB import *

clr.AddReference("RevitNodes")
import Revit
clr.ImportExtensions(Revit.GeometryConversion)

clr.AddReference('RevitServices')
import RevitServices
from RevitServices.Persistence import DocumentManager
doc = DocumentManager.Instance.CurrentDBDocument

items = UnwrapElement(IN[0]) if isinstance(IN[0],list) else [UnwrapElement(IN[0])]
curveList,outsurfaces,outedges,subCategories=[],[],[],[]

opt = Options()
opt.IncludeNonVisibleObjects = False
opt.View = doc.ActiveView

for item in items:
	geoEle=item.get_Geometry(opt)
	if geoEle != None:
		for geoInstance in geoEle:
			if isinstance(geoInstance, GeometryInstance):
				allCurves,outsurface,outedge,subCategory=[],[],[],[]
				for symbIns in geoInstance.GetInstanceGeometry():
				#for symbIns in geoInstance.SymbolGeometry:
					if isinstance(symbIns, Curve):
						allCurves.append(symbIns.ToProtoType())
						subCategory.append(item.Document.GetElement(symbIns.GraphicsStyleId).GraphicsStyleCategory.Name)
						#allCurves.append(symbIns.CreateTransformed(geoInstance.Transform).ToProtoType())
					if isinstance(symbIns, Solid) and symbIns.Volume == 0:
						#solid=SolidUtils.CreateTransformed(symbIns,geoInstance.Transform)
						#for face in solid.Faces:
						for face in symbIns.Faces:
							outsurface.extend(face.ToProtoType())
						#for edge in solid.Edges:	
						for edge in symbIns.Edges:
							outedge.append(edge.AsCurve().ToProtoType())
				curveList.append(allCurves)
				subCategories.append(subCategory)
				outsurfaces.append(outsurface)
				outedges.append(outedge)
	else:
		pass	
if isinstance(IN[0], (list)): OUT = curveList,subCategories,outsurfaces, outedges
else: OUT = curveList[0],subCategories[0],outsurfaces[0],outedges[0]
# ----------------------------------------
code_block = CodeBlock(x=python_script) { x[0]; x[1]; x[2]; x[3]; }
Symbolic_Lines = Output(code_block.out0)
SubCategoryName = Output(code_block.out1)
Surfaces = Output(code_block.out2)
Edges = Output(code_block.out3)
