# Dynamo custom node Get Phase Filter.dyf (Dynamo 1.3.4.6666)
# category: GeniusLoci.Phase
# Get available Phase Filters

get_phase_filter = Python()
# ---------- get_phase_filter.python (18 lines) ----------
#Alban de Chasteigner 2018
#twitter : @geniusloci_bim
#geniusloci.bim@gmail.com

import clr
# Import DocumentManager and TransactionManager
clr.AddReference('RevitServices')
import RevitServices
from RevitServices.Persistence import DocumentManager
doc = DocumentManager.Instance.CurrentDBDocument
# Import RevitAPI
clr.AddReference('RevitAPI')
import Autodesk
from Autodesk.Revit.DB import *

phases = FilteredElementCollector(doc).OfClass(PhaseFilter).ToElements()

OUT = phases
# ----------------------------------------
Phase_Filter = Output(get_phase_filter)
code_block = CodeBlock(e=get_phase_filter) { e.Name; }
Names = Output(code_block)
