# Dynamo custom node Get Project Locations.dyf (Dynamo 1.3.4.6666)
# category: GeniusLoci.Document
# Works only in Revit 2018 and later.
# Retrieves the project positions with the survey point as the origin.
# (Coordinates of Internal origin, project base point and survey point)

docOrRevitLinkInstance = Input(docOrRevitLinkInstance : var = null)  # Use only if you want to query a linked model
get_project_origin_basepoint_and = Python(IN[0]=docOrRevitLinkInstance)  # "Get Project Origin, BasePoint and SurveyPoint"
# ---------- get_project_origin_basepoint_and.python (62 lines) ----------
import clr
import math
# import Document Manager
clr.AddReference("RevitServices")
import RevitServices 
from RevitServices.Persistence import DocumentManager
uiapp = DocumentManager.Instance.CurrentUIApplication
app = uiapp.Application
clr.AddReference("RevitNodes")
import Revit
clr.ImportExtensions(Revit.Elements)
clr.ImportExtensions(Revit.GeometryConversion)
clr.AddReference("RevitAPI")
from Autodesk.Revit.DB import *
import Autodesk

#Part of script from Clockwork
if isinstance(IN[0], list) : inputdoc = UnwrapElement(IN[0])
else : inputdoc = [UnwrapElement(IN[0])]

#Inputdoc : Part of script by Andreas Dieckmann
if inputdoc[0] == None:
    doc = DocumentManager.Instance.CurrentDBDocument
elif inputdoc[0].GetType().ToString() == "Autodesk.Revit.DB.Document":
    doc = inputdoc[0]
elif inputdoc[0].GetType().ToString() == "Autodesk.Revit.DB.RevitLinkInstance":
    doc = inputdoc[0].GetLinkDocument()
else: doc = None

#angleUnit = Document.GetUnits(doc).GetFormatOptions(UnitType.UT_Angle).DisplayUnits

outProjBasePt, outProjSurvPt, outProjLoc = [],[],[]

pbp = FilteredElementCollector(doc).OfCategory(BuiltInCategory.OST_ProjectBasePoint).ToElements()
sbp = FilteredElementCollector(doc).OfCategory(BuiltInCategory.OST_SharedBasePoint).ToElements()

projPos = doc.ActiveProjectLocation.GetProjectPosition(XYZ(0,0,0))

version=int(app.VersionNumber)
if version > 2019 and inputdoc != None :
	#projPos.Angle doesn't work correctly
	#outProjBasePt = [pbp[0].SharedPosition.ToPoint(),round(Autodesk.Revit.DB.UnitUtils.ConvertFromInternalUnits(projPos.Angle,angleUnit),6)]
	outProjBasePt = [pbp[0].SharedPosition.ToPoint(),round(pbp[0].get_Parameter(BuiltInParameter.BASEPOINT_ANGLETON_PARAM).AsDouble()*180/math.pi,6)]
	outProjSurvPt = sbp[0].SharedPosition.ToPoint()
else :
	pbpEW = pbp[0].get_Parameter(BuiltInParameter.BASEPOINT_EASTWEST_PARAM).AsDouble()
	pbpNS = pbp[0].get_Parameter(BuiltInParameter.BASEPOINT_NORTHSOUTH_PARAM).AsDouble()
	pbpElev = pbp[0].get_Parameter(BuiltInParameter.BASEPOINT_ELEVATION_PARAM).AsDouble()
	pbpAngle = pbp[0].get_Parameter(BuiltInParameter.BASEPOINT_ANGLETON_PARAM).AsDouble()*180/math.pi    
	outProjBasePt=[(XYZ(pbpEW,pbpNS,pbpElev)).ToPoint(),round(pbpAngle,6)]

	pspEW = sbp[0].get_Parameter(BuiltInParameter.BASEPOINT_EASTWEST_PARAM).AsDouble()
	pspNS = sbp[0].get_Parameter(BuiltInParameter.BASEPOINT_NORTHSOUTH_PARAM).AsDouble()
	pspElev = sbp[0].get_Parameter(BuiltInParameter.BASEPOINT_ELEVATION_PARAM).AsDouble()
	outProjSurvPt = XYZ(pspEW,pspNS,pspElev).ToPoint()
    	
if projPos == None:
	outProjLoc.append("No Project Position at origin point")
else:
	outProjLoc =XYZ(projPos.EastWest,projPos.NorthSouth,0).ToPoint()
	
OUT = [outProjLoc, outProjBasePt, outProjSurvPt]
# ----------------------------------------
code_block = CodeBlock(x=get_project_origin_basepoint_and) { x[0]; x[1]; x[2]; }
Active_Project_Location = Output(code_block.out0)
Project_Base_Point = Output(code_block.out1)
Project_Survey_Point = Output(code_block.out2)
