# Dynamo custom node Get Shared Parameter.dyf (Dynamo 2.12.0.5650)
# category: GeniusLoci.Parameter
# Get the parameters names, parameters groups, parameters types and assigned categories of the active shared parameter file.

get_shared_parameter_name_and = Python()  # "Get Shared Parameter Name and Group"; IronPython2
# ---------- get_shared_parameter_name_and.python (70 lines) ----------
#Alban de Chasteigner 2019
#twitter : @geniusloci_bim
#geniusloci.bim@gmail.com

import clr
clr.AddReference("RevitServices")
import RevitServices
from RevitServices.Persistence import DocumentManager
doc = DocumentManager.Instance.CurrentDBDocument
uiapp = DocumentManager.Instance.CurrentUIApplication
app = uiapp.Application
version=int(app.VersionNumber)
# Import RevitAPI Classes
clr.AddReference('RevitAPI')
import Autodesk
from Autodesk.Revit.DB import *

clr.AddReference("RevitNodes")
import Revit

uniqueGr,definitions,names,types,guids,groupNames,groups,groupLabels,instances,categories = [],[],[],[],[],[],[],[],[],[]

file = app.OpenSharedParameterFile()
group = file.Groups
for i in group:
	uniqueGr.append(i.Name)
	definitions.append(i.Definitions)

for u, defin in zip(uniqueGr,definitions):
	tempNames,tempTypes,tempGuids,tempGroupNames,tempGroups,tempGroupLabels,isinst,cats=[],[],[],[],[],[],[],[]
	for defi in defin:
		tempNames.append(defi.Name)
		if version < 2022:
			tempTypes.append(defi.ParameterType)
		else:
			tempTypes.append(LabelUtils.GetLabelForSpec(defi.GetDataType()))
		tempGuids.append(defi.GUID)
		tempGroupNames.append(defi.OwnerGroup.Name)
		sp=SharedParameterElement.Lookup(doc, defi.GUID)
		if sp != None:
			tempGroups.append(sp.GetDefinition().ParameterGroup)
			tempGroupLabels.append(LabelUtils.GetLabelFor(sp.GetDefinition().ParameterGroup))
			binding_map = doc.ParameterBindings
			binding = binding_map.Item[sp.GetDefinition()]
			if binding != None and binding.ToString() == 'Autodesk.Revit.DB.InstanceBinding':
				isinst.append(True)
			else:
				isinst.append(False)
			if binding != None:
				category_set = binding.Categories.GetEnumerator()
				cate = [Revit.Elements.Category.ById(cat.Id.IntegerValue) for cat in category_set]
				cats.append(cate)
			else:
				cats.append(None)
		else:
			tempGroups.append(BuiltInParameterGroup.INVALID)
			tempGroupLabels.append(LabelUtils.GetLabelFor(BuiltInParameterGroup.INVALID))
			cats.append(None)
			isinst.append(None)
			
	names.append(tempNames)
	types.append(tempTypes)
	guids.append(tempGuids)
	groupNames.append(tempGroupNames)
	groups.append(tempGroups)
	groupLabels.append(tempGroupLabels)
	instances.append(isinst)
	categories.append(cats)
	
OUT = names,groupNames,uniqueGr,types,groups,groupLabels,instances,guids,categories
# ----------------------------------------
code_block = CodeBlock(x=get_shared_parameter_name_and) { x[0]; x[1]; x[2]; x[3]; x[4]; x[5]; x[6]; x[7]; x[8]; }
ParameterName = Output(code_block.out0)
GroupName = Output(code_block.out1)
Unique_GroupName = Output(code_block.out2)
ParameterType = Output(code_block.out3)
ParameterGroup = Output(code_block.out4)
ParameterGroupLabel = Output(code_block.out5)
IsInstance = Output(code_block.out6)
GUID = Output(code_block.out7)
Categories = Output(code_block.out8)
