# Dynamo custom node Get View By Name.dyf (Dynamo 1.3.4.6666)
# category: GeniusLoci.View
# Collect views by given name in the active or given document.
# Based on a Christian Gartland's script.

ViewName = Input()
DoesContain = Input(DoesContain:bool=false)
docOrRevitLinkInstance = Input(docOrRevitLinkInstance : var = null)  # Use only if you want to query a linked model
get_view_by_name = Python(IN[0]=ViewName, IN[1]=DoesContain, IN[2]=docOrRevitLinkInstance)
# ---------- get_view_by_name.python (48 lines) ----------
#Script by cgartland
import clr
clr.AddReference("RevitServices")
from RevitServices.Persistence import DocumentManager
clr.AddReference("RevitAPI")
from Autodesk.Revit.DB import FilteredElementCollector, View

# Part of script from Clockwork
inputdoc = UnwrapElement(IN[2])
if inputdoc == None:
	doc = DocumentManager.Instance.CurrentDBDocument
elif inputdoc.GetType().ToString() == "Autodesk.Revit.DB.RevitLinkInstance":
	doc = inputdoc.GetLinkDocument()
elif inputdoc.GetType().ToString() == "Autodesk.Revit.DB.Document":
	doc = inputdoc
else: 
	doc = None

def tolist(obj1):
	if hasattr(obj1,"__iter__"): return obj1
	else: return [obj1]

names = tolist(IN[0])
cont = tolist(IN[1])
cont = cont[0]
outList = []

views = {}
views_all = FilteredElementCollector(doc).OfClass(View)
# Create a dictionary associating Names to Views
# e.g. {'3D View 1': View3D}
for view in views_all:
	if not view.IsTemplate:
		views[view.Name] = view

for name in names:
	for key in views.keys():
		if cont:
			if name in key:
				outList.append(views[name])
				break
		else:
			if key == name:
				outList.append(views[name])
				break

if isinstance(IN[0], list): OUT = outList
else: OUT = outList[0]
# ----------------------------------------
Views = Output(get_view_by_name)
