# Dynamo custom node List SortNatural.dyf (Dynamo 1.3.4.6666)
# category: GeniusLoci.Utilities
# Sorts a specified list in natural order in either ascending or descending order.

list = Input()
ascending = Input(ascending:bool=true)
python_script = Python(IN[0]=list, IN[1]=ascending)
# ---------- python_script.python (13 lines) ----------
import re

data=IN[0]
boolean= not IN[1]

def natural_sort(x):
	toStr = [str(l) for l in x]
	convertText = lambda text: int(text) if text.isdigit() else text.lower()
	alphanum = lambda key: [convertText(c) for c in re.split('([0-9]+)', key)]
	return sorted(toStr, key = alphanum, reverse = boolean)

if all(type(x) is list for x in IN[0]) : OUT = [natural_sort(d) for d in data]
else: OUT = natural_sort(data)
# ----------------------------------------
list_2 = Output(python_script)  # "list"
