# Dynamo custom node Material Change Image and Edit it.dyf (Dynamo 1.3.4.6666)
# category: GeniusLoci.Material
# Works only in Revit 2018.1 and later.
# The material must already have an assigned texture.
# Changes the image and edit its properties.
# (All inputs are optional)

material = Input()
filePath = Input(filePath:var[]..[]=null)
Offset_X = Input(Offset_X:double[]..[]=null)  # In Document units
Offset_Y = Input(Offset_Y:double[]..[]=null)  # In Document units
Rotation = Input(Rotation:double[]..[]=null)  # Number within the range of 0..360
Scale_Widht = Input(Scale_Widht:double[]..[]=null)  # In Document units. Minimum of "0.01
Scale_Height = Input(Scale_Height:double[]..[]=null)  # In Document units. Minimum of "0.01
Scale_Lock = Input(Scale_Lock:bool[]..[]=null)  # Boolean
material_change_image_and_edit = Python(IN[0]=material, IN[1]=filePath, IN[2]=Offset_X, IN[3]=Offset_Y, IN[4]=Rotation, IN[5]=Scale_Widht, IN[6]=Scale_Height, IN[7]=Scale_Lock)
# ---------- material_change_image_and_edit.python (87 lines) ----------
#Alban de Chasteigner 2018
#twitter : @geniusloci_bim
#geniusloci.bim@gmail.com
#Inspired by Boris Shafiro from Autodesk
#https://apidocs.co/apps/revit/2019/2e09391a-6aec-f47f-a4e6-bf354bb8629f.htm

import clr
clr.AddReference('RevitAPI')
from Autodesk.Revit.DB import *
from Autodesk.Revit.DB.Visual import *

clr.AddReference('RevitServices')
import RevitServices
from RevitServices.Persistence import DocumentManager
from RevitServices.Transactions import TransactionManager
doc = DocumentManager.Instance.CurrentDBDocument
uiapp = DocumentManager.Instance.CurrentUIApplication
app = uiapp.Application
version=int(app.VersionNumber)

def toList(obj):
    if hasattr(obj, '__iter__'): return obj
    else: return [obj]
    
mats = toList(UnwrapElement(IN[0]))
paths = toList(IN[1])
offsetX = IN[2]
offsetY = IN[3]
angle = IN[4]
scaleWidht = IN[5]
scaleHeight = IN[6]
scaleLock = IN[7]

if version < 2021:
	UIunit = doc.GetUnits().GetFormatOptions(UnitType.UT_Length).DisplayUnits
else:
	UIunit = doc.GetUnits().GetFormatOptions(SpecTypeId.Length).GetUnitTypeId()

for mat, path in zip(mats, paths):
	assetElem = doc.GetElement(mat.AppearanceAssetId)
	TransactionManager.Instance.EnsureInTransaction(doc)
	with Visual.AppearanceAssetEditScope(doc) as editScope:
		editableAsset = editScope.Start(assetElem.Id)
		property = editableAsset.FindByName(Generic.GenericDiffuse)
		connectedAsset = property.GetSingleConnectedAsset()
		if path == None:
			pass
		else:	
			BitMapLocation = connectedAsset.FindByName(UnifiedBitmap.UnifiedbitmapBitmap) 
			if BitMapLocation.IsValidValue(path):
				#AssetProperty String Object
				BitMapLocation.Value = path
		if offsetX == None:
			pass
		else:
			BitmapOffsetX = connectedAsset.FindByName(UnifiedBitmap.TextureRealWorldOffsetX)
			BitmapOffsetX.Value = UnitUtils.ConvertToInternalUnits(offsetX, UIunit)
		if offsetY == None:
			pass
		else:
			BitmapOffsetY = connectedAsset.FindByName(UnifiedBitmap.TextureRealWorldOffsetY)
			BitmapOffsetY.Value = UnitUtils.ConvertToInternalUnits(offsetY, UIunit)
		if angle == None:
			pass
		else:
			TextureWAngle = connectedAsset.FindByName(UnifiedBitmap.TextureWAngle)
			TextureWAngle.Value = angle
		if scaleWidht == None:
			pass
		else:		
			BitmapScaleX = connectedAsset.FindByName(UnifiedBitmap.TextureRealWorldScaleX)
			BitmapScaleX.Value = UnitUtils.ConvertToInternalUnits(scaleWidht, UIunit)
		if scaleHeight == None:
			pass
		else:
			BitmapScaleY = connectedAsset.FindByName(UnifiedBitmap.TextureRealWorldScaleY)
			BitmapScaleY.Value = UnitUtils.ConvertToInternalUnits(scaleHeight, UIunit)
		if scaleLock == None:
			pass
		else:		
			Scalelock = connectedAsset.FindByName(UnifiedBitmap.TextureScaleLock)
			Scalelock.Value = scaleLock

		editScope.Commit(IFailuresPreprocessor)
	TransactionManager.Instance.TransactionTaskDone()

OUT = IN[0]
# ----------------------------------------
Material = Output(material_change_image_and_edit)
