# Dynamo custom node Material Set AppearanceAsset.dyf (Dynamo 1.3.4.6666)
# category: GeniusLoci.Material
# Set the AppearanceAsset Element of the given material.

material = Input()
appearanceAsset = Input()
set_material_appearanceasset = Python(IN[0]=material, IN[1]=appearanceAsset)
# ---------- set_material_appearanceasset.python (34 lines) ----------
#Alban de Chasteigner 2018
#twitter : @geniusloci_bim
#geniusloci.bim@gmail.com

import clr
clr.AddReference('RevitAPI')
from Autodesk.Revit.DB import *

clr.AddReference("RevitNodes")
import Revit
clr.ImportExtensions(Revit.Elements)

clr.AddReference("RevitServices")
import RevitServices
from RevitServices.Persistence import DocumentManager
from RevitServices.Transactions import TransactionManager

def toList(obj):
    if hasattr(obj, '__iter__'): return obj
    else: return [obj]
    
doc = DocumentManager.Instance.CurrentDBDocument
mats = toList(UnwrapElement(IN[0]))
assetElements = toList(UnwrapElement(IN[1]))
appearanceAssetIds=[]

TransactionManager.Instance.EnsureInTransaction(doc)
for mat,assetElement in zip(mats,assetElements):
	mat.AppearanceAssetId = assetElement.Id
	appearanceAssetIds.append(assetElement.Id)
TransactionManager.Instance.TransactionTaskDone()

if isinstance(IN[0], list): OUT = mats
else: OUT = mats[0]
# ----------------------------------------
Material = Output(set_material_appearanceasset)
