# Dynamo custom node Phase Filter ByName.dyf "Get Phase Filter by Name" (Dynamo 1.3.4.6666)
# category: GeniusLoci.Phase
# Enter the name of the phase filter to get the phase filter element.

Name = Input(Name : string)
Refresh = Input(Refresh : bool=true)
python_script = Python(IN[0]=Name, IN[1]=Refresh)
# ---------- python_script.python (30 lines) ----------
#Alban de Chasteigner 2019
#twitter : @geniusloci_bim
#geniusloci.bim@gmail.com

import clr
# Import DocumentManager and TransactionManager
clr.AddReference("RevitServices")
import RevitServices
from RevitServices.Persistence import DocumentManager
doc = DocumentManager.Instance.CurrentDBDocument
# Import RevitAPI Classes
clr.AddReference('RevitAPI')
import Autodesk
from Autodesk.Revit.DB import *

names = IN[0] if isinstance(IN[0],list) else [IN[0]]
toggle = IN[1]

phaseFilters = []
	
if toggle == True:
	collector = FilteredElementCollector(doc).OfClass(PhaseFilter).ToElements()
	for i in collector:
		for name in names:
			if name in i.Name:
				phaseFilters.append(i)		
	if isinstance(IN[0], list): OUT = phaseFilters
	else: OUT = phaseFilters[0]
else:
	OUT = "Set toggle to True"
# ----------------------------------------
Phase_Filter = Output(python_script)
