# Dynamo custom node Plane ByLevel.dyf "Plane by Level" (Dynamo 1.3.4.6666)
# category: GeniusLoci.Level
# Constructs a Plane from a level.

level = Input()
level_plane = Python(IN[0]=level)
# ---------- level_plane.python (24 lines) ----------
#Alban de Chasteigner 2020
#twitter : @geniusloci_bim
#geniusloci.bim@gmail.com

import clr
clr.AddReference('RevitAPI')
import Autodesk
from Autodesk.Revit.DB import *

clr.AddReference('RevitNodes')
import Revit
clr.ImportExtensions(Revit.GeometryConversion)

levels = UnwrapElement(IN[0]) if isinstance(IN[0],list) else [UnwrapElement(IN[0])]
	
planes = []
for level in levels:
	elev=level.Elevation
	point=XYZ(0,0,elev)
	planes.append(Plane.CreateByNormalAndOrigin(XYZ.BasisZ,point).ToPlane())

	
if isinstance(IN[0], (list)): OUT = planes
else: OUT = planes[0]
# ----------------------------------------
Plane = Output(level_plane)
