# Dynamo custom node Publish Coordinates.dyf (Dynamo 1.3.4.6666)
# category: GeniusLoci.Document
# Works only in Revit 2018 and later.
# Publish coordinates to the specified ProjectLocation of the Revit link instance.
# The geolocation information will be pulled from host model to the linked model.

RevitLinkInstance = Input()
LinkProjectLocationName = Input(LinkProjectLocationName:string="Internal")
python_script = Python(IN[0]=RevitLinkInstance, IN[1]=LinkProjectLocationName)
# ---------- python_script.python (34 lines) ----------
#Inspired by https://forum.dynamobim.com/t/publish-coordinates-transactions/42213

import clr
clr.AddReference('RevitAPI')
from Autodesk.Revit.DB import*
clr.AddReference('RevitServices')
from RevitServices.Persistence import DocumentManager
from RevitServices.Transactions import TransactionManager
doc = DocumentManager.Instance.CurrentDBDocument

if isinstance(IN[0], list) :rvtLinkInstances = UnwrapElement(IN[0])
else : rvtLinkInstances = [UnwrapElement(IN[0])]
linkProjLocName = IN[1]
result=[]

for rvtLinkInstance in rvtLinkInstances:
	linkDoc = rvtLinkInstance.GetLinkDocument()
	TransactionManager.Instance.ForceCloseTransaction()
	linkLocations = linkDoc.ProjectLocations
	for linkLocation in linkLocations:
		if linkLocation.Name == linkProjLocName:
			t = Transaction(doc, "Publish Project Location")
			t.Start()
			try: 
				doc.PublishCoordinates(LinkElementId(rvtLinkInstance.Id, linkLocation.Id))
				message = "Project Location successfully published"
				t.Commit()
			except Exception as e: 
				message = "Could not publish project location due to: " + str(e)
				t.RollBack() 
		else: continue	
	result.append(message)

OUT = result
# ----------------------------------------
Result = Output(python_script)
