# Dynamo custom node Remove Special Characters from String.dyf (Dynamo 1.3.4.6666)
# category: GeniusLoci.Utilities
# Useful for removing invalid characters from filenames.
# For use with the FilenameToFilePaths node.

String = Input()
remove_forbidden_ascii = Python(IN[0]=String)  # "Remove forbidden ASCII characters"
# ---------- remove_forbidden_ascii.python (12 lines) ----------
#https://kite.com/python/answers/how-to-remove-special-characters-from-a-string-in-python

# if input is not a list , make a list
strings = IN[0] if isinstance(IN[0],list) else [IN[0]]

result = []

for char in strings:
    result.append(''.join(c for c in char if c.isalnum()))

if isinstance(IN[0], list): OUT = result 
else: OUT = result[0]
# ----------------------------------------
String_2 = Output(remove_forbidden_ascii)  # "String"
