# Dynamo custom node Revision to Sheet.dyf (Dynamo 1.3.4.6666)
# category: GeniusLoci.Sheet
# Returns the ViewSheets where this Revision participates in the sheet's revision schedule.

revision = Input(revision:var)
python_script = Python(IN[0]=revision)
# ---------- python_script.python (20 lines) ----------
#Alban de Chasteigner 2020
#twitter : @geniusloci_bim
#geniusloci.bim@gmail.com
#https://github.com/albandechasteigner/GeniusLociForDynamo
 
import clr
clr.AddReference('RevitAPI')
import Autodesk
from Autodesk.Revit.DB import FilteredElementCollector,ViewSheet

clr.AddReference('RevitServices')
import RevitServices
from RevitServices.Persistence import DocumentManager
doc = DocumentManager.Instance.CurrentDBDocument

revision = UnwrapElement(IN[0])

sheets = FilteredElementCollector(doc).OfClass(ViewSheet).ToElements().FindAll(lambda x :  x.GetAllRevisionIds().Contains(revision.Id))

OUT = sheets
# ----------------------------------------
Sheets = Output(python_script)
