# Dynamo custom node Room ByName.dyf "Get rooms by name or number" (Dynamo 1.3.4.6666)
# category: GeniusLoci.Room
# Enter the room name or number to get the room.
# Inspired by jeremy@learndynamo.com

NameOrNumber = Input(NameOrNumber : string)
Refresh = Input(Refresh :bool=true)
get_rooms_by_name_or_number = Python(IN[0]=NameOrNumber, IN[1]=Refresh)
# ---------- get_rooms_by_name_or_number.python (32 lines) ----------
#Node Inspired by jeremy@learndynamo.com
#www.Learndynamo.com 

import clr
# Import DocumentManager and TransactionManager
clr.AddReference("RevitServices")
import RevitServices
from RevitServices.Persistence import DocumentManager
doc = DocumentManager.Instance.CurrentDBDocument
# Import RevitAPI Classes
clr.AddReference('RevitAPI')
import Autodesk
from Autodesk.Revit.DB import *

namnums = IN[0] if isinstance(IN[0],list) else [IN[0]]
toggle = IN[1]

rooms,roomLevels = [], []
	
if toggle == True:
	collector = FilteredElementCollector(doc).OfCategory(BuiltInCategory.OST_Rooms)
	for i in collector:
		for namnum in namnums:
			if namnum in i.get_Parameter(BuiltInParameter.ROOM_NAME).AsString() or namnum in i.get_Parameter(BuiltInParameter.ROOM_NUMBER).AsString():
				if i.Location != None:	
					rooms.append(i)
					roomLevels.append(i.Level)
										
	if isinstance(IN[0], list): OUT = rooms, roomLevels 
	else: OUT = rooms[0], roomLevels[0]
else:
	OUT = "Set toggle to True"
# ----------------------------------------
code_block = CodeBlock(x=get_rooms_by_name_or_number) { x[0]; x[1]; }
Rooms = Output(code_block.out0)
Levels = Output(code_block.out1)
