# Dynamo custom node SelectByCateOrTypeAndLevel.dyf "SelectByCategoryAndByLevel" (Dynamo 1.3.4.6666)
# category: GeniusLoci.Select
# Select Elements by Category and Level.
# With linked documents, use the "Collector of Levels" node to obtain the linked level input.

level = Input(level:var)  # Collected level in active or linked document
category = Input()
selectByCategory = Python(IN[0]=level, IN[1]=category)
# ---------- selectByCategory.python (90 lines) ----------
#Alban de Chasteigner 2019
#twitter : @geniusloci_bim
#geniusloci.bim@gmail.com
#https://github.com/albandechasteigner/GeniusLociForDynamo

import clr
clr.AddReference('RevitNodes')
import Revit
clr.ImportExtensions(Revit.Elements)

clr.AddReference('RevitAPI')
from Autodesk.Revit.DB import FilteredElementCollector, Document, RevitLinkInstance, ElementMulticategoryFilter, ElementId, BuiltInCategory,BuiltInParameter, Level

from System.Collections.Generic import List

def tolist(obj1):
	if hasattr(obj1,"__iter__"): return obj1
	else: return [obj1]

SelectedLevel = tolist(UnwrapElement(IN[0]))[0]
cats = tolist(UnwrapElement(IN[1]))

doc = SelectedLevel.Document
elem = []

#ueWrapper by Dimitar Venkov
ueWrapper = None
wrappers = clr.GetClrType(Revit.Elements.ElementWrapper).GetMethods()
for w in wrappers:
	if w.ToString().startswith("Revit.Elements.UnknownElement"):
		ueWrapper = w
		break
		
catId = List[ElementId](c.Id for c in cats)
filter = ElementMulticategoryFilter(catId)
		
coll = FilteredElementCollector(doc).WhereElementIsNotElementType().WherePasses(filter)

#Inspired by Clockwork
def GetLevel(item):
	val = None
	if hasattr(item, "LevelId"): 
		val = item.Document.GetElement(item.LevelId)
		if val: return val
	if hasattr(item, "Level"):
		val = item.Level
		if val: return val
	if hasattr(item, "GenLevel"):
		val = item.GenLevel
		if val: return val
	if (item.GetType().ToString() in ("Autodesk.Revit.DB.Architecture.StairsRun", "Autodesk.Revit.DB.Architecture.StairsLanding")):
		item = item.GetStairs()
	if (item.GetType().ToString() == "Autodesk.Revit.DB.Architecture.Stairs") or item.Category.Id == ElementId(BuiltInCategory.OST_Ramps):
		try: return item.Document.GetElement(item.get_Parameter(BuiltInParameter.STAIRS_BASE_LEVEL_PARAM).AsElementId())
		except: pass
	if (item.GetType().ToString() == "Autodesk.Revit.DB.ExtrusionRoof"):
		try: return item.Document.GetElement(item.get_Parameter(BuiltInParameter.ROOF_CONSTRAINT_LEVEL_PARAM).AsElementId())
		except: pass
	if (item.GetType().ToString() == "Autodesk.Revit.DB.Mechanical.Duct" or "Autodesk.Revit.DB.Electrical.Conduit"):
		try: return item.Document.GetElement(item.get_Parameter(BuiltInParameter.RBS_START_LEVEL_PARAM).AsElementId())
		except: pass
	if hasattr(item, "OwnerViewId"):
		view = item.Document.GetElement(item.OwnerViewId)
		if hasattr(view, "GenLevel"):
			val = view.GenLevel
			if val: return val
	if not val:
		try: return item.Document.GetElement(item.get_Parameter(BuiltInParameter.INSTANCE_REFERENCE_LEVEL_PARAM).AsElementId())
		except: 
			try: return item.Document.GetElement(item.get_Parameter(BuiltInParameter.INSTANCE_SCHEDULE_ONLY_LEVEL_PARAM).AsElementId())
			except: 
				try: return item.Document.GetElement(item.get_Parameter(BuiltInParameter.SCHEDULE_LEVEL_PARAM).AsElementId())
				except:
					#if item is work plane based
					collector = FilteredElementCollector(item.Document).OfClass(Level).ToElements()
					try: return [level for level in collector if item.get_Parameter(BuiltInParameter.SKETCH_PLANE_PARAM).AsString().split(": ")[-1] == level.Name][0]
					except: return None

for col in coll :
	if GetLevel(col) and GetLevel(col).Id == SelectedLevel.Id:
		try:
			elem.append(col.ToDSType(True))
		except:
			if ueWrapper:
				elem.append(ueWrapper.Invoke(None,(col, True)))
			#elem.append(col.ToDSType(True))

OUT = elem
coll.Dispose()
filter.Dispose()
# ----------------------------------------
Elements = Output(selectByCategory)
