# Dynamo custom node SelectByCategory in Document.dyf (Dynamo 1.3.4.6666)
# category: GeniusLoci.Select
# Collect elements by category in a linked or open document in the background.
# The transform CS is returned only with a LinkInstance input.

category = Input()
docOrRevitLinkInstance = Input(docOrRevitLinkInstance : var[]..[] = null)  # Use only if you want to query a linked model
selectByCategory = Python(IN[0]=category, IN[1]=docOrRevitLinkInstance)
# ---------- selectByCategory.python (59 lines) ----------
import clr
clr.AddReference("RevitNodes")
import Revit
clr.ImportExtensions(Revit.Elements)

clr.AddReference('RevitServices')
from RevitServices.Persistence import DocumentManager

clr.AddReference("RevitAPI")
from Autodesk.Revit.DB import FilteredElementCollector, Document, RevitLinkInstance, ElementMulticategoryFilter, ElementId

from System.Collections.Generic import List
import System

def tolist(obj1):
	if hasattr(obj1,"__iter__"): return obj1
	else: return [obj1]

cats = tolist(UnwrapElement(IN[0]))
inputdocs = tolist(UnwrapElement(IN[1]))
elem, transforms = [], []

#Inspired by Clockwork
for inputdoc in inputdocs :
	if inputdoc == None:
		doc = DocumentManager.Instance.CurrentDBDocument
	elif isinstance (inputdoc, Document):
		doc = inputdoc
	elif isinstance (inputdoc, RevitLinkInstance):
		doc = inputdoc.GetLinkDocument()
		try:
			transforms.append(inputdoc.GetTotalTransform().ToCoordinateSystem(1))
		except: 
			transforms.append(None)
	else: doc = DocumentManager.Instance.CurrentDBDocument

#ueWrapper from Dimitar Venkov
ueWrapper = None
wrappers = clr.GetClrType(Revit.Elements.ElementWrapper).GetMethods()
for w in wrappers:
	if w.ToString().startswith("Revit.Elements.UnknownElement"):
		ueWrapper = w
		break
		
catId = List[ElementId](c.Id for c in cats)
filter = ElementMulticategoryFilter(catId)
		
coll = FilteredElementCollector(doc).WhereElementIsNotElementType().WherePasses(filter)

for c in coll :
	try:
		elem.append(c.ToDSType(True))
	except:
		if ueWrapper:
			elem.append(ueWrapper.Invoke(None,(c, True)))

OUT = elem,transforms
coll.Dispose()
filter.Dispose()
# ----------------------------------------
code_block = CodeBlock(x=selectByCategory) { x[0]; x[1]; }
Element = Output(code_block.out0)
Transform = Output(code_block.out1)
