# Dynamo custom node SelectByFilter.dyf (Dynamo 1.3.4.6666)
# category: GeniusLoci.Select
# Retrieves elements by the name of the selection set or rule-based filter.

FilterName = Input(FilterName : string)
python_script = Python(IN[0]=FilterName)
# ---------- python_script.python (29 lines) ----------
#Inspired by Christian Gartland
import clr
clr.AddReference('RevitAPI')
from Autodesk.Revit.DB import FilteredElementCollector, ParameterFilterElement, SelectionFilterElement
clr.AddReference('RevitServices')
from RevitServices.Persistence import DocumentManager

doc = DocumentManager.Instance.CurrentDBDocument
name = IN[0]

elements, user_selection = [], []
# Get all ParameterFilterElements in doc
filter_elements = FilteredElementCollector(doc).OfClass(ParameterFilterElement)
filter_names = [f.Name for f in filter_elements]
filters = [f.GetElementFilter() for f in filter_elements]
filter_dict = dict(zip(filter_names, filters))

if name in filter_dict:
	filter = filter_dict[name]
	elements = FilteredElementCollector(doc).WhereElementIsNotElementType().WherePasses(filter).ToElements()

selection_sets = FilteredElementCollector(doc).OfClass(SelectionFilterElement)

for s in selection_sets:
	if s.Name == name:
		ids = s.GetElementIds()
		elements = [doc.GetElement(e) for e in ids]
		
OUT = elements
# ----------------------------------------
Element = Output(python_script)
