# Dynamo custom node SelectByFilterAndView.dyf (Dynamo 1.3.4.6666)
# category: GeniusLoci.Select
# Retrieves elements by the name of the selection set or rule-based filter in the given view.

FilterName = Input(FilterName : string)
view = Input(view : var= Revit.Application.Document.Current.ActiveView)
python_script = Python(IN[0]=FilterName, IN[1]=view)
# ---------- python_script.python (34 lines) ----------
##Alban de Chasteigner 2021
#twitter : @geniusloci_bim
#geniusloci.bim@gmail.com
#https://github.com/albandechasteigner/GeniusLociForDynamo

import clr
clr.AddReference('RevitAPI')
from Autodesk.Revit.DB import FilteredElementCollector, ParameterFilterElement, SelectionFilterElement
clr.AddReference('RevitServices')
from RevitServices.Persistence import DocumentManager

doc = DocumentManager.Instance.CurrentDBDocument
name = IN[0]
view = UnwrapElement(IN[1])

elements, user_selection = [], []
# Get all ParameterFilterElements in doc
filter_elements = FilteredElementCollector(doc).OfClass(ParameterFilterElement)
filter_names = [f.Name for f in filter_elements]
filters = [f.GetElementFilter() for f in filter_elements]
filter_dict = dict(zip(filter_names, filters))

if name in filter_dict:
	filter = filter_dict[name]
	elements = FilteredElementCollector(doc,view.Id).WhereElementIsNotElementType().WherePasses(filter).ToElements()

selection_sets = FilteredElementCollector(doc,view.Id).OfClass(SelectionFilterElement)

for s in selection_sets:
	if s.Name == name:
		ids = s.GetElementIds()
		elements = [doc.GetElement(e) for e in ids]
		
OUT = elements
# ----------------------------------------
Element = Output(python_script)
