# Dynamo custom node Set DWG Export Setup.dyf (Dynamo 1.3.4.6666)
# category: GeniusLoci.CAD Export
# Sets the DWGExportOptions stored in the ExportDwgSettings.

ExportDwgSettings = Input()
DWGExportOptions = Input()
setDWGExportOptions = Python(IN[0]=ExportDwgSettings, IN[1]=DWGExportOptions)
# ---------- setDWGExportOptions.python (31 lines) ----------
#Alban de Chasteigner 2018
#twitter : @geniusloci_bim
#geniusloci.bim@gmail.com

import clr
clr.AddReference('RevitAPI')
from Autodesk.Revit.DB import *

clr.AddReference("RevitNodes")
import Revit
clr.ImportExtensions(Revit.Elements)

clr.AddReference("RevitServices")
import RevitServices
from RevitServices.Persistence import DocumentManager
from RevitServices.Transactions import TransactionManager

doc = DocumentManager.Instance.CurrentDBDocument

def toList(obj):
    if hasattr(obj, '__iter__'): return obj
    else: return [obj]

settings = toList(UnwrapElement(IN[0]))
DWGExportOptions = toList(UnwrapElement(IN[1]))

TransactionManager.Instance.EnsureInTransaction(doc)
for i in settings:
	option = i.SetDWGExportOptions(DWGExportOptions[0])
TransactionManager.Instance.TransactionTaskDone()
OUT = settings
# ----------------------------------------
ExportDwgSettings_2 = Output(setDWGExportOptions)  # "ExportDwgSettings"
