# Dynamo custom node Set ProjectLocation by Name.dyf (Dynamo 1.3.4.6666)
# category: GeniusLoci.Document
# Set the Site by its name.

Name = Input(Name : string[]..[])  # ProjectLocation's name
python_script = Python(IN[0]=Name)
# ---------- python_script.python (19 lines) ----------
import clr
clr.AddReference('RevitAPI')
from Autodesk.Revit.DB import*
clr.AddReference('RevitServices')
from RevitServices.Persistence import DocumentManager
from RevitServices.Transactions import TransactionManager
doc = DocumentManager.Instance.CurrentDBDocument

locations = FilteredElementCollector(doc).OfClass(ProjectLocation).ToElements()
TransactionManager.Instance.EnsureInTransaction(doc)
for loc in locations:
	if loc.Name == IN[0]:
		doc.ActiveProjectLocation = loc
		break
	else:
		pass
TransactionManager.Instance.TransactionTaskDone()

OUT = loc
# ----------------------------------------
ProjectLocation = Output(python_script)
