# Dynamo custom node SetParameterByName in Document.dyf (Dynamo 1.3.4.6666)
# category: GeniusLoci.Parameter
# Set the element's parameters from a specific document.

element = Input(element:Revit.Elements.Element[]..[])
parameterName = Input(parameterName : string)
value = Input(value : var)
document = Input(document: var = null)
python_script = Python(IN[0]=element, IN[1]=parameterName, IN[2]=value, IN[3]=document)
# ---------- python_script.python (55 lines) ----------
import clr
clr.AddReference('RevitAPI')
from Autodesk.Revit.DB import *

clr.AddReference('RevitServices')
import RevitServices
from RevitServices.Persistence import DocumentManager
from RevitServices.Transactions import TransactionManager
uiapp = DocumentManager.Instance.CurrentUIApplication
app = uiapp.Application
version=int(app.VersionNumber)

elements = UnwrapElement(IN[0]) if isinstance(IN[0],list) else [UnwrapElement(IN[0])]
parameter_names = UnwrapElement(IN[1]) if isinstance(IN[1],list) else [UnwrapElement(IN[1])]
values = UnwrapElement(IN[2]) if isinstance(IN[2],list) else [UnwrapElement(IN[2])]
inputdocs = UnwrapElement(IN[3]) if isinstance(IN[3],list) else [UnwrapElement(IN[3])]
inputdoc=inputdocs[0]

#Part of script from Clockwork
if inputdoc == None:
	doc = DocumentManager.Instance.CurrentDBDocument
elif inputdoc.GetType().ToString() == "Autodesk.Revit.DB.Document":
	doc = inputdoc
else: doc = DocumentManager.Instance.CurrentDBDocument

def setdata(items,params,values):
	for i,param_name in enumerate(params):
		for elem in items: 
			param = elem.LookupParameter(param_name)
			if param == None:
				param = elem.Document.GetElement(elem.GetTypeId()).LookupParameter(param_name)
			if param.StorageType == StorageType.Double:
				if version < 2021:
					param.Set(UnitUtils.ConvertToInternalUnits(values[i],param.DisplayUnitType))
				else:
					param.Set(UnitUtils.ConvertToInternalUnits(values[i],param.GetUnitTypeId()))
			elif param.StorageType == StorageType.ElementId:
				param.Set(values[i].Id)
			else:
				param.Set(values[i])
		return items

try:
	TransactionManager.Instance.ForceCloseTransaction()
	t = Transaction(doc,'Set')
	t.Start()
	data=setdata(elements,parameter_names,values)
	t.Commit()      
	OUT = data, doc

except:
    # if error accurs anywhere in the process catch it
    import traceback
    errorReport = traceback.format_exc()
    OUT = errorReport
# ----------------------------------------
code_block = CodeBlock(x=python_script) { x[0]; x[1]; }
Element = Output(code_block.out0)
Document = Output(code_block.out1)
