# Dynamo custom node Sheet ByName.dyf (Dynamo 1.3.4.6666)
# category: GeniusLoci.Sheet
# Collects sheets by name or number in the active or given document.

NameOrNumber = Input(NameOrNumber : string[]..[])
docOrRevitLinkInstance = Input(docOrRevitLinkInstance : var[]..[] = null)  # Use only if you want to query a linked model
python_script = Python(IN[0]=NameOrNumber, IN[1]=docOrRevitLinkInstance)
# ---------- python_script.python (31 lines) ----------
#Alban de Chasteigner 2021
#twitter : @geniusloci_bim
#geniusloci.bim@gmail.com
#https://github.com/albandechasteigner/GeniusLociForDynamo

import clr
clr.AddReference('RevitServices')
import RevitServices
from RevitServices.Persistence import DocumentManager
clr.AddReference('RevitAPI')
import Autodesk
from Autodesk.Revit.DB import Document, RevitLinkInstance, FilteredElementCollector, ViewSheet

namnums = IN[0] if isinstance(IN[0],list) else [IN[0]]
inputdoc = (UnwrapElement(IN[1]) if isinstance(IN[1],list) else [UnwrapElement(IN[1])])[0]

#Inspired by Clockwork
if inputdoc == None:
	doc = DocumentManager.Instance.CurrentDBDocument
elif isinstance (inputdoc, Document):
	doc = inputdoc
elif isinstance (inputdoc, RevitLinkInstance):
	doc = inputdoc.GetLinkDocument()
else: doc = DocumentManager.Instance.CurrentDBDocument

collector = FilteredElementCollector(doc).OfClass(Autodesk.Revit.DB.ViewSheet)

sheets=[s for s in collector for namnum in namnums if namnum in s.SheetNumber or namnum in s.Name]

if len(sheets)>1 : OUT = sheets
else: OUT = sheets[0]
# ----------------------------------------
Sheet = Output(python_script)
