# Dynamo custom node Space ToElement.dyf (Dynamo 2.16.2.5624)
# category: GeniusLoci.Room
# Reports the elements of the current or linked model that are inside the given space of the current document.

space = Input(space: var[]..[])  # Space of current document
RevitLinksInstance = Input(RevitLinksInstance: var[]..[] = null)  # Optional input to retrieve linked elements
python_script = Python(IN[0]=space, IN[1]=RevitLinksInstance)  # IronPython2
# ---------- python_script.python (52 lines) ----------
#Alban de Chasteigner 2021
#twitter : @geniusloci_bim
#geniusloci.bim@gmail.com
#https://github.com/albandechasteigner/GeniusLociForDynamo
 
import clr
clr.AddReference('RevitAPI')
import Autodesk
from Autodesk.Revit.DB import *
clr.AddReference("RevitServices")
import RevitServices
from RevitServices.Persistence import DocumentManager

spaces = UnwrapElement(IN[0]) if isinstance(IN[0],list) else [UnwrapElement(IN[0])]
inputdoc = UnwrapElement(IN[1])
result=[]

if inputdoc is None:
	doc = DocumentManager.Instance.CurrentDBDocument
	transform = Transform.Identity
elif isinstance (inputdoc, RevitLinkInstance):
	doc = inputdoc.GetLinkDocument()
	transform = inputdoc.GetTotalTransform()
for space in spaces:
	elem=[]
	fec = FilteredElementCollector(doc).WhereElementIsNotElementType().WhereElementIsViewIndependent().ToElements().FindAll(lambda x :  type(x.Location) == LocationPoint and x.Category.Id != ElementId(BuiltInCategory.OST_MEPSpaces) or type(x.Location) == LocationCurve or isinstance(x, CeilingAndFloor) or isinstance(x,RoofBase))
	for e in fec:
		loc = e.Location
		if type(loc) == LocationPoint:
			pt=loc.Point
		elif type(loc) == LocationCurve:
			pt=loc.Curve.Evaluate(0.5, False)
		# sketch-based elements (ceiling, floor and roof)
		elif isinstance(e, CeilingAndFloor) or isinstance(e,RoofBase) :
			try:
				for ref in HostObjectUtils.GetTopFaces(e):
					geomFace=e.GetGeometryObjectFromReference(ref)
					#Get UV BoundingBox
					bbox = geomFace.GetBoundingBox()
					uv=(bbox.Min+bbox.Max)/2
					pt=geomFace.Evaluate(uv)
			except:
				box = e.get_BoundingBox(None)
				pt = (box.Min+box.Max)/2
				
		locationPoint = transform.OfPoint(pt)
		if space.IsPointInSpace(locationPoint):
			elem.append(e)
	result.append(elem)
	
if isinstance(IN[0], list): OUT = result
else: OUT = result[0]
# ----------------------------------------
Element = Output(python_script)  # Elements of current document or linked model
