# Dynamo custom node Tag TaggedElement.dyf (Dynamo 2.12.0.5650)
# category: GeniusLoci.Tag
# Get tagged element.
# Unlike the OOTB node it works also for linked element, linked room, room, space and area categories.

tag = Input(tag: var[]..[])
docOrRevitLinkInstance = Input(docOrRevitLinkInstance: var[]..[] = null)  # Use only if you want to query a linked model
tag_get_tagged_element = Python(IN[0]=tag, IN[1]=docOrRevitLinkInstance)  # IronPython2
# ---------- tag_get_tagged_element.python (62 lines) ----------
#Alban de Chasteigner 2018
#twitter : @geniusloci_bim
#geniusloci.bim@gmail.com

import clr
clr.AddReference('RevitAPI')
from Autodesk.Revit.DB import *
import Autodesk

clr.AddReference("RevitServices")
import RevitServices
from RevitServices.Persistence import DocumentManager
uiapp = DocumentManager.Instance.CurrentUIApplication
app = uiapp.Application
version=int(app.VersionNumber)

def tolist(x):
    if hasattr(x,'__iter__'): return x
    else : return [x]

tags = tolist(UnwrapElement(IN[0]))
inputdocs = tolist(UnwrapElement(IN[1]))

linkedrooms,rooms,spaces,areas,elements,linkedelements = [],[],[],[],[],[]

for tag in tags:
	for inputdoc in inputdocs :
		#Inputdoc : Part of script by Andreas Dieckmann
		if inputdoc == None:
			doc = DocumentManager.Instance.CurrentDBDocument
		elif inputdoc.GetType().ToString() == "Autodesk.Revit.DB.Document":
			doc = inputdoc
		elif inputdoc.GetType().ToString() == "Autodesk.Revit.DB.RevitLinkInstance":
			doc = inputdoc.GetLinkDocument()
		tagType = doc.GetElement(tag.GetTypeId())
		if inputdoc != None:
			try:
				if version < 2022:
					linkedelements.append(doc.GetElement((tag.TaggedElementId).LinkedElementId))
				else:
					linkedelements = [doc.GetElement(x.LinkedElementId) for x in tag.GetTaggedElementIds()]
				result = linkedelements
			except:
				linkedrooms.append(doc.GetElement((tag.TaggedRoomId).LinkedElementId))
				result = linkedrooms
		elif tagType.Category.Id == ElementId(BuiltInCategory.OST_RoomTags):
			rooms.append(tag.Room)
			result = rooms
		elif tagType.Category.Id == ElementId(BuiltInCategory.OST_MEPSpaceTags):
			spaces.append(tag.Space)
			result = spaces
		elif tagType.Category.Id == ElementId(BuiltInCategory.OST_AreaTags):
			areas.append(tag.Area)
			result = areas
		else:
			if version < 2022:
				elements.append(doc.GetElement(tag.TaggedLocalElementId))
			else:
				elements = [doc.GetElement(x) for x in tag.GetTaggedLocalElementIds()]
			result = elements
		
OUT = filter(None,result)
# ----------------------------------------
Element = Output(tag_get_tagged_element)
