# Dynamo custom node TitleBlock From Sheet.dyf "Titleblock From Sheet" (Dynamo 1.3.4.6666)
# category: GeniusLoci.Printing
# Retrieves the titleblock from the given sheet in the active or given document.

sheet = Input()  # Sheet of active or given document
python_script = Python(IN[0]=sheet)
# ---------- python_script.python (21 lines) ----------
#Alban de Chasteigner 2019
#twitter : @geniusloci_bim
#geniusloci.bim@gmail.com

import clr
# Import RevitAPI Classes
clr.AddReference('RevitAPI')
from Autodesk.Revit.DB import *

if isinstance(IN[0], list) : sheets = UnwrapElement(IN[0])
else : sheets = [UnwrapElement(IN[0])]

titleBlock=[]
for sheet in sheets:
	doc=sheet.Document
	title=FilteredElementCollector(doc,sheet.Id).OfCategory(BuiltInCategory.OST_TitleBlocks).ToElements()
	titleBlock.append(title)

#Assign your output to the OUT variable.
if isinstance(IN[0], list): OUT = titleBlock
else: OUT = titleBlock[0]
# ----------------------------------------
TitleBlock = Output(python_script)
