# Dynamo custom node Unfold Concave.dyf (Dynamo 1.3.4.6666)
# category: GeniusLoci.Geometry
# Unfold curved elements like Walls or stairs.
# An inner perimeter circle of the element must be drawn to intersect the geometry with it.

line = Input()  # Drawn perimeter circle. (Revit line)
geometry = Element.Geometry(line)
length = Curve.Length(geometry)
cylinder_height = CodeBlock(a=length) { -a; }
byWidthLength = Rectangle.ByWidthLength(width=length, length=cylinder_height)
byPatch = Surface.ByPatch(byWidthLength)
extrude = Curve.Extrude(curve=geometry, distance=cylinder_height)
Curved_element = Input()
flatten_solids = CodeBlock(x=Curved_element) { DSCore.List.Clean(DSCore.List.Flatten(x.Solids,-1), false); }
# note: Inspired by a Mostafa El Ayoubi's graph
byUnion = Solid.ByUnion(flatten_solids)
intersect = Geometry.Intersect(geometry=byUnion, other=extrude)
perimeterCurves = Surface.PerimeterCurves(intersect)
flatten = Flatten(perimeterCurves)
startPoint = Curve.StartPoint(flatten)
UVParameterAtPoint = Surface.UVParameterAtPoint(extrude, startPoint, lacing=Longest)
U = UV.U(UVParameterAtPoint)
V = UV.V(UVParameterAtPoint)
pointAtParameter = Surface.PointAtParameter(surface=byPatch, u=U, v=V, lacing=Longest)
code_block = CodeBlock { 0.5; }
pointAtParameter_2 = Curve.PointAtParameter(curve=flatten, param=code_block)
UVParameterAtPoint_2 = Surface.UVParameterAtPoint(extrude, pointAtParameter_2, lacing=Longest)
U_2 = UV.U(UVParameterAtPoint_2)
V_2 = UV.V(UVParameterAtPoint_2)
pointAtParameter_3 = Surface.PointAtParameter(surface=byPatch, u=U_2, v=V_2, lacing=Longest)
endPoint = Curve.EndPoint(flatten)
UVParameterAtPoint_3 = Surface.UVParameterAtPoint(extrude, endPoint, lacing=Longest)
U_3 = UV.U(UVParameterAtPoint_3)
V_3 = UV.V(UVParameterAtPoint_3)
pointAtParameter_4 = Surface.PointAtParameter(surface=byPatch, u=U_3, v=V_3, lacing=Longest)
create = List.Create(pointAtParameter, pointAtParameter_3, pointAtParameter_4)
transpose = List.Transpose(create)
code_block_2 = CodeBlock { 2; }
byPoints = NurbsCurve.ByPoints(transpose@L2, code_block_2)
Curves = Output(byPoints)
