# Dynamo custom node Unload RevitLinkType in Document.dyf (Dynamo 1.3.4.6666)
# category: GeniusLoci.Import
# Unloads all Revit links in a document Revit.
# Based on a Ben Osborne's script.

document = Input(document : var[]..[] = null)  # Use only if you want to query other document
python_script = Python(IN[0]=document)
# ---------- python_script.python (32 lines) ----------
#From Ben_Osborne
import clr
clr.AddReference('RevitAPI')
from Autodesk.Revit.DB import *

clr.AddReference("RevitServices")
import RevitServices
from RevitServices.Persistence import DocumentManager
from RevitServices.Transactions import TransactionManager

if isinstance(IN[0], list) : inputdoc = UnwrapElement(IN[0])
else : inputdoc = [UnwrapElement(IN[0])]

#Inputdoc : Part of script by Andreas Dieckmann
if inputdoc[0] == None:
    doc = DocumentManager.Instance.CurrentDBDocument
elif inputdoc[0].GetType().ToString() == "Autodesk.Revit.DB.Document":
    doc = inputdoc[0]
elif inputdoc[0].GetType().ToString() == "Autodesk.Revit.DB.RevitLinkInstance":
    doc = inputdoc[0].GetLinkDocument()
else: doc = DocumentManager.Instance.CurrentDBDocument

revitLinkTypes=[]
linkcollector=FilteredElementCollector(doc).OfClass(RevitLinkInstance)

TransactionManager.Instance.ForceCloseTransaction()
for link in linkcollector:
	linkType=doc.GetElement(link.GetTypeId())
	revitLinkTypes.append(linkType)
	linkType.Unload(None)
	
OUT= doc,revitLinkTypes
# ----------------------------------------
code_block = CodeBlock(x=python_script) { x[0]; x[1]; }
Document = Output(code_block.out0)
RevitLinkType = Output(code_block.out1)
