# Dynamo custom node View Add Filter.dyf (Dynamo 1.3.4.6666)
# category: GeniusLoci.Graphics
# Add a Filter and set its overrides to a view. Unlike the OOTB nodes, it also works with SelectionFilterElement.
# For use with the Create OverrideGraphicSettings node.

view = Input(view:var[]..[] = Revit.Application.Document.Current.ActiveView)
filterElement = Input()  # String (FilterElement's name), SelectionFilter or ParameterFilter
overrides = Input(overrides:var[]..[]=null)  # Revit.DB.OverrideGraphicSettings Optional input
visible = Input(visible:bool=true)  # If True the filter will be visible
python_script = Python(IN[0]=view, IN[1]=filterElement, IN[2]=overrides, IN[3]=visible)
# ---------- python_script.python (45 lines) ----------
#Inspired by Cyril Poupin on https://forum.dynamobim.com/
import clr
clr.AddReference('RevitAPI')
import Autodesk
from Autodesk.Revit.DB import *

clr.AddReference('RevitServices')
import RevitServices
from RevitServices.Persistence import DocumentManager
from RevitServices.Transactions import TransactionManager
doc = DocumentManager.Instance.CurrentDBDocument

def getfilterByName(nameFilter):
	collfilter = FilteredElementCollector(doc).OfClass(FilterElement).ToElements()
	if collfilter:
		filterSelect = [x for x in collfilter if x.Name == nameFilter]
		if filterSelect:
			return filterSelect[0]
		else: return None	

views = UnwrapElement(IN[0]) if isinstance(IN[0],list) else [UnwrapElement(IN[0])]
nameFilter = UnwrapElement(IN[1])
override = IN[2]
visible = IN[3]

outViews = []
if isinstance (nameFilter, basestring):
	filter = getfilterByName(nameFilter)
elif isinstance (nameFilter, FilterElement):
	filter = nameFilter
if filter:
	TransactionManager.Instance.EnsureInTransaction(doc)
	for view in views:
		if view.AreGraphicsOverridesAllowed():
			if not view.IsFilterApplied(filter.Id):
				view.AddFilter(filter.Id)
				if override:
					view.SetFilterOverrides(filter.Id,override)
				view.SetFilterVisibility(filter.Id, visible)	
				outViews.append(view)
	TransactionManager.Instance.TransactionTaskDone()
	
	OUT = outViews
else:
	OUT = "Filter not found"
# ----------------------------------------
View = Output(python_script)
