# Dynamo custom node View ApplyViewTemplate.dyf (Dynamo 1.3.4.6666)
# category: GeniusLoci.View
# Applies to the given view the properties that are not controlled by the assigned view template. (Similar to the "Apply Template Properties" command of Revit)

view = Input()
viewTemplate = Input()  # Source view from which to take properties
python_script = Python(IN[0]=view, IN[1]=viewTemplate)
# ---------- python_script.python (20 lines) ----------
import clr
clr.AddReference('RevitAPI')
from Autodesk.Revit.DB import *

clr.AddReference('RevitServices')
import RevitServices
from RevitServices.Persistence import DocumentManager
from RevitServices.Transactions import TransactionManager
doc = DocumentManager.Instance.CurrentDBDocument

views = UnwrapElement(IN[0]) if isinstance(IN[0],list) else [UnwrapElement(IN[0])]
viewTemplate = UnwrapElement(IN[1])

TransactionManager.Instance.EnsureInTransaction(doc)
for view in views:
	view.ApplyViewTemplateParameters(viewTemplate)
TransactionManager.Instance.TransactionTaskDone()

if isinstance(IN[0], list): OUT = views
else: OUT = views[0]
# ----------------------------------------
View = Output(python_script)
