# Dynamo custom node View ByType.dyf "Get View By Type" (Dynamo 1.3.4.6666)
# category: GeniusLoci.View
# Gets all views by type.
# For the View Template Type, the 3D View Templates will not be retrieved.

viewType = Input()  # For use with the View Type or the ViewFamilyTypes nodes String or ViewFamilyType
docOrRevitLinkInstance = Input(docOrRevitLinkInstance : var[]..[] = null)  # Use only to query a linked model
python_script = Python(IN[0]=viewType, IN[1]=docOrRevitLinkInstance)
# ---------- python_script.python (41 lines) ----------
#Inspired by archilab
import clr
clr.AddReference('RevitAPI')
import Autodesk
from Autodesk.Revit.DB import *

clr.AddReference('RevitServices')
import RevitServices
from RevitServices.Persistence import DocumentManager

import System

viewType = UnwrapElement(IN[0])
inputdocs = UnwrapElement(IN[1]) if isinstance(IN[1],list) else [UnwrapElement(IN[1])]

for inputdoc in inputdocs :
	if inputdoc == None:
		doc = DocumentManager.Instance.CurrentDBDocument
	elif isinstance (inputdoc, Document) :
		doc = inputdoc
	elif isinstance (inputdoc, RevitLinkInstance) :
		doc = inputdoc.GetLinkDocument()
	else: doc = DocumentManager.Instance.CurrentDBDocument

viewList=[]
colViews = FilteredElementCollector(doc).OfClass(View).ToElements()

for v in colViews:
	if viewType != "View Template" and isinstance(viewType,basestring) :
		vType  = System.Enum.Parse(Autodesk.Revit.DB.ViewType, IN[0])
		#fType  = (doc.GetElement(v.GetTypeId())).get_Parameter(BuiltInParameter.ALL_MODEL_TYPE_NAME).AsString()
		if v.ViewType == vType and not v.IsTemplate:
			viewList.Add(v)
	elif isinstance(viewType,ViewFamilyType) :
		if v.GetTypeId() == viewType.Id:
			viewList.Add(v)
	elif viewType == "View Template":
		if v.ViewType != ViewType.ThreeD and v.IsTemplate:
			viewList.Add(v)

OUT=viewList
# ----------------------------------------
Views = Output(python_script)
