# Dynamo custom node View SetElementOverrides.dyf (Dynamo 1.3.4.6666)
# category: GeniusLoci.Graphics
# Overrides element graphics settings in the given view.
# For use with the Create OverrideGraphicSettings node.
# Can also be used to hide or unhide elements.

view = Input(view:var[]..[] = Revit.Application.Document.Current.ActiveView)
elements = Input()
overrides = Input(overrides:var[]..[]=null)  # Revit.DB.OverrideGraphicSettings Optional input
hide = Input(hide:bool=false)  # True to hide the given element False to unhide the given element
python_script = Python(IN[0]=view, IN[1]=elements, IN[2]=overrides, IN[3]=hide)
# ---------- python_script.python (55 lines) ----------
import clr
#Import the Revit API
clr.AddReference('RevitAPI')
import Autodesk
from Autodesk.Revit.DB import *

#Import DocumentManager and TransactionManager
clr.AddReference('RevitServices')
import RevitServices
from RevitServices.Persistence import DocumentManager
from RevitServices.Transactions import TransactionManager
doc = DocumentManager.Instance.CurrentDBDocument

import System
from System.Collections.Generic import List

def tolist(obj1):
	if hasattr(obj1,"__iter__"): return obj1
	else: return [obj1]

#def by Konrad Sobon, archilab
def HideElements(v, elements):
	ids = List[ElementId]()
	for e in elements:
		if not e.IsHidden(v) and e.CanBeHidden(v):
			ids.Add(e.Id)
	v.HideElements(ids)
	return None

#def by Konrad Sobon, archilab
def UnhideElements(v, elements):
	ids = List[ElementId]()
	for e in elements:
		if e.IsHidden(v):
			ids.Add(e.Id)
	if len(ids) > 0:
		v.UnhideElements(ids)
	return None

views = tolist(UnwrapElement(IN[0]))
elems = tolist(UnwrapElement(IN[1]))
ogs = IN[2]
hide = IN[3]
output = []

TransactionManager.Instance.EnsureInTransaction(doc)
for v in views:
	if ogs:
		result = [v.SetElementOverrides(e.Id, ogs) for e in elems]
	if hide : HideElements(v, elems)
	else : UnhideElements(v, elems)
TransactionManager.Instance.TransactionTaskDone()

if isinstance(IN[1], list): OUT = views
else: OUT = views[0]
# ----------------------------------------
View = Output(python_script)
