# Dynamo custom node Wall CompoundStructureLayersLocation.dyf (Dynamo 1.3.4.6666)
# category: GeniusLoci.CompoundStructure
# Get the wall layers location lines.

wall = Input()
wall_orientation_layerswidths = Python(IN[0]=wall)
# ---------- wall_orientation_layerswidths.python (77 lines) ----------
#Alban de Chasteigner 2018
#twitter : @geniusloci_bim
#geniusloci.bim@gmail.com
#https://github.com/albandechasteigner/GeniusLociForDynamo

import clr
clr.AddReference('RevitAPI')
from Autodesk.Revit.DB import *

clr.AddReference('RevitServices')
import RevitServices
from RevitServices.Persistence import DocumentManager
doc = DocumentManager.Instance.CurrentDBDocument
uiapp = DocumentManager.Instance.CurrentUIApplication
app = uiapp.Application
version=int(app.VersionNumber)

clr.AddReference("RevitNodes")
import Revit
clr.ImportExtensions(Revit.Elements)
clr.ImportExtensions(Revit.GeometryConversion)

#By Clockwork
def WallOrientation(wall):
	loc = wall.Location
	flipped = False
	if hasattr(loc, "Curve"):
		lcurve = loc.Curve
		if hasattr(wall, "Flipped"): flipped = wall.Flipped
		if str(type(lcurve)) == "Autodesk.Revit.DB.Line":
			if flipped: return wall.Orientation.ToVector().Reverse()
			else: return wall.Orientation.ToVector()
		else:
			direction = (lcurve.GetEndPoint(1) - lcurve.GetEndPoint(0)).Normalize()
			if flipped: return XYZ.BasisZ.CrossProduct(direction).ToVector().Reverse()
			else: return XYZ.BasisZ.CrossProduct(direction).ToVector()
	else: return None

if version < 2021:
	UIunit = doc.GetUnits().GetFormatOptions(UnitType.UT_Length).DisplayUnits
else:
	UIunit = doc.GetUnits().GetFormatOptions(SpecTypeId.Length).GetUnitTypeId()

items = UnwrapElement(IN[0]) if isinstance(IN[0],list) else [UnwrapElement(IN[0])]

elemwidth,elemfunc = [],[]

#By Clockwork
for item in items:
	try:
		counter = 0
		layerwidth,layerfunc = [],[]
		compstruc = item.WallType.GetCompoundStructure()
		num = compstruc.LayerCount
		while counter < num:
			layerwidth.append(UnitUtils.ConvertFromInternalUnits((compstruc.GetLayerWidth(counter)),UIunit))
			layerfunc.append(compstruc.GetLayerFunction(counter))
			counter += 1
	except:
		pass
	elemwidth.append(layerwidth)
	elemfunc.append(layerfunc)

#By salvatoredragotta
Incrementals=[]
for data in elemwidth :
	Incremental=[]
	Incremental.append(data[0])
	i=0
	while i <len(data)-1:
		result=(Incremental[i]+data[i+1])
		Incremental.append(result)
		i +=1
	Incrementals.append(Incremental)

if isinstance(IN[0], list): OUT = [WallOrientation(x) for x in items],elemwidth,Incrementals,elemfunc
else: OUT = [WallOrientation(x) for x in items][0],elemwidth[0],Incrementals[0],elemfunc[0]
# ----------------------------------------
code_block = CodeBlock(x=wall_orientation_layerswidths) { x[0]; x[1]; x[2]; x[3]; }
code_block_2 = CodeBlock(wall=wall, direction=code_block.out0, width=code_block.out1, addition=code_block.out2) { (wall.GetLocation()).Translate(direction,(DSCore.Math.Sum(width)/2-(addition-(width/2)))); }
Curves = Output(code_block_2)
LayerFunctions = Output(code_block.out3)
